# Grasshopper definition bistable_auxetic_final.gh (Grasshopper 1.0.7)
# plug-ins: NGon, Kangaroo Components, Kangaroo2 Components, MeshEdit Components, Weaverbird

# ---- group: Conical Mesh generation. If you don't have a perfect conical mesh, run this part to get one!
crv = Curve([<curve referenced from the Rhino model> x84])  # disabled
disc = Discontinuity(Curve=crv, Level=1)  # -> Points, Parameters; disabled
conmesh = ConstructMesh(Vertices=disc.Points, Faces={A=0, B=1, C=2, D=3})  # disabled
mesh = Mesh(flatten(conmesh))  # disabled
wbjoin = WeaverbirdsJoinMeshesAndWeld(Mesh=mesh, Weld=True)  # disabled
unifynormals = MeshUnifyNormals(Mesh=wbjoin)  # disabled
flip = MeshFlip(Mesh=unifynormals)  # disabled

number_slider = Slider(1000000, range=0..1000000)  # disabled
number_slider_2 = Slider(10, range=-10..10)  # disabled
conical = Conicalize(M=flip, Strength=number_slider)  # disabled
show = Show(G=flip)  # disabled
planarize = Planarize(M=flip, Strength=number_slider)  # disabled
number_slider_3 = Slider(0.24, range=0..1)  # disabled
toggle = BooleanToggle(False)  # disabled
button = Button()  # disabled
faceface = FaceFaceOffset(Mesh=flip, Distance=number_slider_2)  # -> Offset, Beams; disabled
entwine = Entwine(Branch00=show, Branch01=flatten([conical, planarize]), FlattenInputs=True)  # disabled
bouncysolver = BouncySolver(GoalObjects=entwine, Reset=button, Threshold=1e-15, Tolerance=number_slider_3, Damping=0.99, Iterations=10, On=toggle)  # -> I, V, O; disabled
unflatten = UnflattenTree(Tree=bouncysolver.O, Guide=entwine)  # disabled
branch = TreeBranch(Tree=simplify(unflatten), Path="{0}", MaintainPaths=True)  # disabled
wbjoin_2 = WeaverbirdsJoinMeshesAndWeld(Mesh=branch, Weld=True)  # disabled
unifynormals_2 = MeshUnifyNormals(Mesh=wbjoin_2)  # disabled

# ---- group: Conical Mesh generation. If you don't have a perfect conical mesh, run this part to get one! / reverse direction
flip_2 = MeshFlip(Mesh=unifynormals_2)  # disabled

# ----
mesh_2 = Mesh(<mesh referenced from the Rhino model>)

# ---- group: switch to change between clockwise and counter-clockwise
toggle_2 = BooleanToggle(False)

# ----
height = Slider(5, range=0..10)
number_slider_4 = Slider(1, range=0..1.56)
ibase = Slider(8, range=-10..120)
rad = Radians(Degrees=Slider(15, range=0..15))
addition = Addition(A=ibase, B=height)
num = Number(0)
swatch = ColourSwatch(SwatchColor=RGB(155, 186, 185))

mesh_3 = Mesh(mesh_2)
faceface_2 = FaceFaceOffset(Mesh=mesh_3, Distance=Slider(84, range=0..1000))  # -> Offset, Beams
explode = MeshExplode(Mesh=faceface_2.Beams, Interpolate=False)
top = GetPolylines(Mesh=explode)  # -> flatten(Polylines)
nv = NakedVertices(Mesh=mesh_3)  # -> ClothedIndex, NakedIndex, ClothedPts, NakedPts
disc_2 = Discontinuity(Curve=top, Level=1)  # -> Points, Parameters
demesh = DeconstructMesh(Mesh=mesh_3)  # -> Vertices, Faces, Colours, Normals
item = ListItem(List=disc_2.Points, Index=[0, 1], Wrap=True)  # -> simplify(Item)
cluster = Cluster(F=demesh.Faces)
cp = ClosestPoint(Point=item, Cloud=demesh.Vertices)  # -> ClosestPoint, CPIndex, Distance
facen = FaceNormals(Mesh=mesh_3)  # -> Centers, unitize(Normals)
int = Integer(nv.NakedIndex)
int_2 = Integer(cp.CPIndex)
int_3 = Integer(cluster)
c_script = CSharpScript(EdgeI=int_2, NakedI=int)  # -> out, NakedBeam; inputs EdgeI: tree of Int32, NakedI: list
# ---------- c_script: C# ----------
    List<bool> isNakedBeam = new List<bool>();
    for(int i = 0;i < EdgeI.BranchCount;i++){
      if(NakedI.Contains(EdgeI.Branches[i][0]) && NakedI.Contains(EdgeI.Branches[i][1])){
        isNakedBeam.Add(true);
      }
      else{
        isNakedBeam.Add(false);
      }
    }
    NakedBeam = isNakedBeam;
# ---------- end c_script ----------
cluster_2 = Cluster_2(P=facen.Normals)
c_script_2 = CSharpScript(EdgeI=int_2, FaceI=int_3)  # -> out, FaceEdgeI; inputs EdgeI: tree of Int32, FaceI: tree of Int32
# ---------- c_script_2: C# ----------
    List<List<int>> faceEList = new List<List<int>>();
    DataTree<int> faceETree = new DataTree<int>();
    
    for(int i = 0;i < FaceI.BranchCount;i++){
      List<int> subList = new List<int>();
      for(int j = 0;j < EdgeI.BranchCount;j++){
        if(FaceI.Branches[i].Contains(EdgeI.Branches[j][0]) && FaceI.Branches[i].Contains(EdgeI.Branches[j][1])){
          subList.Add(j);
        }
      }
      faceEList.Add(subList);
    }
    
    //Tree construction for NEdge
    for(int i = 0; i < faceEList.Count;i++){
      for(int j = 0;j < faceEList[i].Count;j++){
        faceETree.Add(faceEList[i][j], new GH_Path(i));
      }
    }
    FaceEdgeI = faceETree;
# ---------- end c_script_2 ----------
cluster_3 = Cluster_3(P=facen.Normals)
c_script_3 = CSharpScript(
    mesh=mesh_3,
    halfN=cluster_2,
    startI=cluster_3,
    isNakedBeam=c_script.NakedBeam,
    faceBeamI=c_script_2.FaceEdgeI,
    beam=explode)  # -> out, trimmedBeam, traversalIndex; inputs mesh: Mesh, halfN: list of Vector3d, startI: Int32, isNakedBeam: list of Boolean, faceBeamI: tree of Int32, beam: list of Mesh
# ---------- c_script_3: C# usings ----------
using System.Linq;
using Rhino.Geometry.Collections;
using Rhino.Geometry.Intersect;
# ---------- c_script_3: C# ----------
    // Index Traversal
    List<List<int>> traversalBeam = traverseFaceIndex(startI, mesh);
    DataTree<int> traversalTree = new DataTree<int>();
    for(int i = 0; i < traversalBeam.Count;i++){
      for(int j = 0;j < traversalBeam[i].Count;j++){
        traversalTree.Add(traversalBeam[i][j], new GH_Path(i));
      }
    }
    traversalIndex = traversalTree;

    // Construct Traversed beams
    List<List<List<Mesh>>> beamGroups = new List<List<List<Mesh>>>();
    foreach(List<int> epoch in traversalBeam){
      List<List<Mesh>> beamsThisEpoch = new List<List<Mesh>>();
      foreach(int groupId in epoch){
        List<Mesh> beamThisGroup = new List<Mesh>();
        foreach(int id in faceBeamI.Branches[groupId]){
          beamThisGroup.Add(beam[id]);
        }
        beamsThisEpoch.Add(beamThisGroup);
      }
      beamGroups.Add(beamsThisEpoch);
    }
    
    // Start iterating intersections to get Secs
    List<Mesh> startGroup = beamGroups[0][0];
    List<int> remainBeamsId = Enumerable.Range(0, beam.Count - 1).ToList();
    List<int> calculatedBeamsId = new List<int>();
    Line[] calcedSecs = new Line[beam.Count];

    for(int i = 0;i < beamGroups.Count;i++){
      if(i == 0){
        // calculate cut Secs; add and remove BeamId to corresponding list; add Sec to Array:calcedSecs
        List<Polyline> startSecs = getStartEdge(startGroup, halfN[startI]);
        int temp = 0;
        foreach(int beamId in faceBeamI.Branches[traversalBeam[0][0]]){
          calculatedBeamsId.Add(beamId);
          remainBeamsId.Remove(beamId);
          calcedSecs[beamId] = new Line(startSecs[temp].PointAt(0.0), startSecs[temp].PointAt(1.0));
          temp++;
        }
      }
      else{
        for(int j = 0;j < beamGroups[i].Count;j++){
          List<Mesh> thisGroup = beamGroups[i][j];
          List<int> thisGroupBeamId = faceBeamI.Branches[traversalBeam[i][j]];
          List<Point3d> potentialPts = new List<Point3d>();
          foreach(int thisId in thisGroupBeamId){
            if(calculatedBeamsId.Contains(thisId)){
              Line cand = calcedSecs[thisId];
              potentialPts.Add(cand.PointAt(0.0));
            }
          }
          Point3d thisStartPt = potentialPts[0];
          List<Polyline> groupSecs = getGroupEdge(thisGroup, halfN[traversalBeam[i][j]], thisStartPt);
          int temp = 0;
          foreach(int thisId in thisGroupBeamId){
            calculatedBeamsId.Add(thisId);
            remainBeamsId.Remove(thisId);
            calcedSecs[thisId] = new Line(groupSecs[temp].PointAt(0.0), groupSecs[temp].PointAt(1.0));
            temp++;
          }
        }
      }
    }
    
    //Output Secs
    trimmedBeam = calcedSecs;
# ---------- c_script_3: C# additional code ----------
  public List<List<int>> traverseFaceIndex(int startId, Mesh m){
    List<List<int>> traversal = new List<List<int>>();
    List<int> remain = Enumerable.Range(0, m.Faces.Count).ToList();
    int generation = 0;
    List<int> currentGen = new List<int>();
    List<int> calculated = new List<int>();
    while(remain.Any()){
      List<int> nextGen = new List<int>();
      if(generation == 0){
        currentGen.Add(startId);
        calculated.Add(startId);
        remain.Remove(startId);
        nextGen = m.Faces.AdjacentFaces(startId).ToList();
      }
      else{
        foreach(int k in currentGen){
          List<int> adjF = m.Faces.AdjacentFaces(k).ToList();
          foreach(int kk in adjF){
            bool alreadyCalculated = calculated.Contains(kk);
            bool alreadyAddedNext = nextGen.Contains(kk);
            if(!alreadyCalculated && !alreadyAddedNext){
              nextGen.Add(kk);
            }
          }
          calculated.Add(k);
          remain.Remove(k);
        }
      }
      traversal.Add(currentGen);
      currentGen = new List<int>(nextGen);
      generation += 1;
    }
    return traversal;
  }

  public List<Polyline> getStartEdge(List<Mesh> startBeamGroup, Vector3d targetNormal){
    List<Polyline> edges = new List<Polyline>();
    Mesh beam1 = startBeamGroup[0];
    SortedList<float,Point3d> upperPts = new SortedList<float,Point3d>();
    foreach(Mesh m in startBeamGroup){
      if(upperPts.Keys.Contains(m.Vertices[3].Z)){
        upperPts.Add(m.Vertices[2].Z, m.Vertices[2]);
      }
      else{
        upperPts.Add(m.Vertices[3].Z, m.Vertices[3]);
      }
    }

    Point3d p = upperPts.Values[0];
    Plane targetPlane = new Plane(p, targetNormal);
    foreach(Mesh subbeam in startBeamGroup){
      edges.Add(Intersection.MeshPlane(subbeam, targetPlane)[0]);
    }
    return edges;
  }

  public List<Polyline> getGroupEdge(List<Mesh> beamGroup, Vector3d targetNormal, Point3d startPoint){
    List<Polyline> edges = new List<Polyline>();
    Plane targetPlane = new Plane(startPoint, targetNormal);
    foreach(Mesh subbeam in beamGroup){
      edges.Add(Intersection.MeshPlane(subbeam, targetPlane)[0]);
    }
    return edges;
  }
# ---------- end c_script_3 ----------
xy = XYPlane(Origin=Point(0, 0, 0))

# ---- group: construct trimmed beams
demesh_2 = DeconstructMesh(Mesh=explode)  # -> Vertices, Faces, Colours, Normals
crv_2 = Curve(c_script_3.trimmedBeam)
end = EndPoints(Curve=crv_2)  # -> simplify(graft(Start)), simplify(graft(End))
item_2 = ListItem(List=simplify(demesh_2.Vertices), Index=0, Wrap=True)  # -> Item, Item1
merge = Merge(Data1=item_2.Item, Data2=item_2.Item1, Data3=end.End, Data4=end.Start)
conmesh_2 = ConstructMesh(Vertices=merge, Faces={A=0, B=1, C=2, D=3})

# ----
top_2 = GetPolylines(Mesh=conmesh_2)  # -> flatten(Polylines)
item_3 = ListItem(List=crv_2, Index=c_script_2.FaceEdgeI, Wrap=True)
item_4 = ListItem(List=flatten(top_2), Index=c_script_2.FaceEdgeI, Wrap=True)
cluster_4 = Cluster_5(C=item_3)
dispatch = Dispatch(List=flatten(top_2), DispatchPattern=c_script.NakedBeam)  # -> ListA, ListB
end_2 = EndPoints(Curve=item_3)  # -> Start, End
pl_3pt = Plane3Pt(PointA=end_2.Start, PointB=end_2.End, PointC=cluster_4)
boundary = BoundarySurfaces(Edges=dispatch.ListB)
mirror = Mirror(Geometry=pl_3pt, Plane=xy)  # -> Geometry, Transform
orient = Orient(Geometry=simplify(item_4), Source=pl_3pt, Target=mirror.Geometry)  # -> Geometry, Transform
cluster_5 = Cluster_4(crv=orient.Geometry)
crv_3 = Curve(cluster_5)
crv_4 = Curve(flatten(crv_3))

crv_5 = Curve(crv_4)
dam = DataDam(DataA=crv_5, BufferDelay=10000000, BufferMode=0)
crv_6 = Curve(dam)

cls = Closed(Curve=crv_6)  # -> Closed, Periodic
dispatch_2 = Dispatch(List=crv_6, DispatchPattern=cls.Closed)  # -> ListA, ListB
disc_3 = Discontinuity(Curve=dispatch_2.ListA, Level=1)  # -> simplify(Points), Parameters
conmesh_3 = ConstructMesh(Vertices=disc_3.Points, Faces={A=0, B=1, C=2, D=3})

mesh_4 = Mesh(flatten(conmesh_3))

mjoin = MeshJoin(Meshes=mesh_4)
weld = WeldMesh(Mesh=mjoin, Radius=Slider(0.1, range=0..0.1), Align=False, Use_RTree=False)
meshedges = MeshEdges(Mesh=weld)  # -> AllE, NakedE
crv_7 = Curve(meshedges.AllE)
dupln = RemoveDuplicateLines(Lines=crv_7, Tolerance=Slider(0.02, range=0..0.1))
end_3 = EndPoints(Curve=dupln)  # -> Start, End
pt = Point(graft(end_3.Start))
pt_2 = Point(graft(end_3.End))

merge_2 = Merge(Data1=end_3.Start, Data2=end_3.End)  # -> flatten(Result)
duppt = RemoveDuplicatePts(Points=merge_2, Tolerance=Slider(0.02, range=0..1))

# ---- group: v(n*3)
pt_3 = Point(duppt)
pdecon = Deconstruct(Point=pt_3)  # -> XComponent, YComponent, ZComponent

# ----
cp_2 = ClosestPoint(Point=pt, Cloud=pt_3)  # -> ClosestPoint, CPIndex, Distance
cp_3 = ClosestPoint(Point=pt_2, Cloud=pt_3)  # -> ClosestPoint, CPIndex, Distance
num_2 = Number(flatten(cp_2.CPIndex))
num_3 = Number(flatten(cp_3.CPIndex))

# ---- group: SOLVE MIN Z
sort = SortList(Keys=pdecon.ZComponent)  # -> Keys, ValuesA
item_5 = ListItem(List=sort.Keys, Index=0, Wrap=True)

# ---- group: MAX POINT FOR MIRROR
sort_2 = SortList(Keys=pdecon.ZComponent, ValuesA=pt_3)  # -> Keys, reverse(ValuesA)
item_6 = ListItem(List=sort_2.ValuesA, Index=0, Wrap=True)

# ---- group: ground value of z
num_4 = Number(expr("x+0.05", item_5))

# ---- group: l(n*2)
merge_3 = Merge(Data1=graft(num_2), Data2=graft(num_3))  # -> simplify(Result)

# ---- group: bool: isOnGround
smaller = SmallerThan(FirstNumber=pdecon.ZComponent, SecondNumber=num_4)  # -> SmallerThan, OrEqualTo

# ----
indentifing_the_ration_axes = CSharpScript(v=pt_3, l=merge_3, isOnGround=smaller.SmallerThan)  # -> out, list_RA, o_l; inputs v: list of Point3d, l: tree of Int32, isOnGround: list of Boolean
# ---------- indentifing_the_ration_axes: C# usings ----------
using System.Linq;
using System.Runtime;
# ---------- indentifing_the_ration_axes: C# ----------
    List<int> listRA = new List<int>();

    for(int i = 0;i < l.BranchCount;i++){
      if(isOnGround[l.Branches[i][0]] && !isOnGround[l.Branches[i][1]]){
        l.Branches[i].Reverse();
      }
    }//Sorting direction of node to corners

    for(int i = 0;i < l.BranchCount;i++){
      if(!isOnGround[l.Branches[i][0]] && !isOnGround[l.Branches[i][1]]){
        int countThis = 0;
        int countThat = 0;
        for(int j = 0;j < l.BranchCount;j++){
          if(isOnGround[l.Branches[j][1]] && (l.Branches[i][0] == l.Branches[j][0])){
            countThis += 1;
          }
          if(isOnGround[l.Branches[j][1]] && (l.Branches[i][1] == l.Branches[j][0])){
            countThat += 1;
          }
        }
        if (countThis > 3 || countThat > 3){
          listRA.Add(i);
        }
      }
    }

    list_RA = listRA;
    o_l = l;
# ---------- end indentifing_the_ration_axes ----------

# ---- group: test visulization: points on the ground
dispatch_3 = Dispatch(List=pt_3, DispatchPattern=smaller.SmallerThan)  # -> ListA, ListB
pt_4 = Point(dispatch_3.ListA)

# ---- group: list_RA
num_5 = Number(indentifing_the_ration_axes.list_RA)

# ----
c_script_4 = CSharpScript(iSwap=toggle_2, list_RA=num_5, l=indentifing_the_ration_axes.o_l)  # -> out, o_l; inputs iSwap: Boolean, list_RA: list of Int32, l: tree of Int32
# ---------- c_script_4: C# usings ----------
using System.Linq;
# ---------- c_script_4: C# ----------
    if(iSwap){
      foreach(int index in list_RA){
        l.Branches[index].Reverse();
      }
    }
    List<int> f = list_RA.GetRange(0, 1);
    List<int> cand = list_RA.GetRange(1, list_RA.Count - 1);
    List<int> ff = new List<int>();
    int a = 0;

    while(cand.Any()){
      ff = new List<int>();
      for(int i = 0;i < f.Count;i++){
        for(int k = 0;k < cand.Count;k++){
          int j = cand[k];
          bool j1Element = l.Branches[j][0] == l.Branches[f[i]][0];
          if(j1Element){
            cand.Remove(j);
            ff.Add(j);
            //break;
          }
          bool j2Element = l.Branches[j][1] == l.Branches[f[i]][0];
          if(j2Element){
            l.Branches[j].Reverse();
            cand.Remove(j);
            ff.Add(j);
            //break;
          }
          bool j3Element = l.Branches[j][1] == l.Branches[f[i]][1];
          if(j3Element){
            cand.Remove(j);
            ff.Add(j);
            //break;
          }
          bool j4Element = l.Branches[j][0] == l.Branches[f[i]][1];
          if(j4Element){
            l.Branches[j].Reverse();
            cand.Remove(j);
            ff.Add(j);
            //break;
          }
        }
      }
      f = ff;
      a++;
    }

    o_l = l;
    //iteration = a;
    //%% determint the direction of the rotation axes
    //if 1 % swap
    //  l(list_RA(1), :) = l(list_RA(1), end:-1:1);
    //end

    //  f = list_RA(1); % initiate the fixed list
    //cand = list_RA(2:end); % initiate the "to be checked" list

    //while ~isempty(cand)
    //  ff=[];
    //  for i = 1:length(f)
    //    j1 = l(cand, 1) == l(f(i), 1); % Check the direction of rotation axes. These are correct.
    //    j2 = l(cand, 2) == l(f(i), 1); % Check the direction of rotation axes. These are not desired.
    //    l(cand(j2), :) = l(cand(j2), end:-1:1); % reverse the direction
    //    j3 = l(cand, 2) == l(f(i), 2); % Check the direction of rotation axes. These are correct.
    //    j4 = l(cand, 1) == l(f(i), 2); % Check the direction of rotation axes. These are not desired.
    //    l(cand(j4), :) = l(cand(j4), end:-1:1); % reverse the direction
    //    ff=[ff;cand(j1);cand(j2);cand(j3);cand(j4)]; % Update the fixed list
    //    cand = cand(~j1 & ~j2 & ~j3 & ~j4); % Update the "to be checked" list
    //  end
    //  f = ff;
    //end
# ---------- end c_script_4 ----------

# ---- group: l_FINAL
num_6 = Number(c_script_4.o_l)

# ---- group: test visualization: rotation axes
branch_2 = TreeBranch(Tree=num_6, Path=num_5, MaintainPaths=True)
item_7 = ListItem(List=pt_3, Index=branch_2, Wrap=True)
item_8 = ListItem(List=item_7, Index=0, Wrap=True)  # -> Item, Item1
ln = Line(StartPoint=item_8.Item, EndPoint=item_8.Item1)  # -> flatten(Line)

# ----
c_script_5 = CSharpScript(meshes=mesh_4, facePoints=disc_3.Points, v=pt_3, l=num_6, list_RA=num_5)  # -> out, RA_Faces; inputs meshes: list of Mesh, facePoints: tree of Point3d, v: list of Point3d, l: tree of Int32, list_RA: list of Int32
# ---------- c_script_5: C# ----------
    double tolerance = 0.01;
    List<List<Mesh>> RA_Meshes = new List<List<Mesh>>();
    DataTree<Mesh> RA_MeshTree = new DataTree<Mesh>();
    for(int i = 0;i < list_RA.Count;i++){
      List<Mesh> sublist = new List<Mesh>();
      Point3d p1 = v[l.Branches[list_RA[i]][0]];
      Point3d p2 = v[l.Branches[list_RA[i]][1]];
      for(int j = 0;j < meshes.Count;j++){
        Point3d pA = facePoints.Branches[j][0];
        Point3d pB = facePoints.Branches[j][1];
        Point3d pC = facePoints.Branches[j][2];
        Point3d pD = facePoints.Branches[j][3];
        bool thisbool = (pA.DistanceTo(p1) < tolerance || pB.DistanceTo(p1) < tolerance || pC.DistanceTo(p1) < tolerance || pD.DistanceTo(p1) < tolerance) && (pA.DistanceTo(p2) < tolerance || pB.DistanceTo(p2) < tolerance || pC.DistanceTo(p2) < tolerance || pD.DistanceTo(p2) < tolerance);
        if(thisbool){
          sublist.Add(meshes[j]);
        }
      }
      RA_Meshes.Add(sublist);
    }
    for(int i = 0; i < RA_Meshes.Count;i++){
      for(int j = 0;j < RA_Meshes[i].Count;j++){
        RA_MeshTree.Add(RA_Meshes[i][j], new GH_Path(i));
      }
    }

    RA_Faces = RA_MeshTree;
# ---------- end c_script_5 ----------

facen_2 = FaceNormals(Mesh=c_script_5.RA_Faces)  # -> Centers, Normals
trim = TrimTree(Tree=facen_2.Normals, Depth=1)
item_9 = ListItem(List=trim, Index=0, Wrap=True)  # -> Item, Item1
angle = Angle(VectorA=item_9.Item, VectorB=item_9.Item1)  # -> flatten(Angle), Reflex
c_script_6 = CSharpScript(x=angle.Angle)  # -> out, ang_GP; inputs x: list of Double
# ---------- c_script_6: C# ----------
    for(int i = 0;i < x.Count;i++){
      if(x[i] > Math.PI / 2){x[i] = Math.PI - x[i];}
    }
    ang_GP = x;
# ---------- end c_script_6 ----------

graph_of_nodes = CSharpScript(
    v=pt_3,
    l=num_6,
    list_RA=num_5,
    RA_Faces=c_script_5.RA_Faces,
    ang_GP=c_script_6.ang_GP,
    isOnGround=smaller.SmallerThan,
    tilt=rad,
    height=height,
    i_base=ibase,
    offset=number_slider_4)  # -> out, A, B, C, D, traversal, DoFs, startIndex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; inputs v: list of Point3d, l: tree of Int32, list_RA: list of Int32, RA_Faces: tree of Mesh, ang_GP: list of Double, isOnGround: list of Boolean, tilt: Double, height: Double, i_base: Double, offset: Double
# ---------- graph_of_nodes: C# ----------
    Graph g = new Graph();
    List<Point3d> ListN = new List<Point3d>();
    List<Point3d> ListP = new List<Point3d>();

    List<Node> NodePList = new List<Node>();
    List<Node> NodeNList = new List<Node>();

    DataTree<Point3d> TreeN = new DataTree<Point3d>();
    DataTree<Point3d> TreeP = new DataTree<Point3d>();

    List<List<Point3d>> NNeigh = new List<List<Point3d>>();
    List<List<Point3d>> PNeigh = new List<List<Point3d>>();

    DataTree<Line> TreeEdgesN = new DataTree<Line>();
    DataTree<Line> TreeEdgesP = new DataTree<Line>();
    List<List<Line>> ListEdgeN = new List<List<Line>>();
    List<List<Line>> ListEdgeP = new List<List<Line>>();

    //Construct Graph g with node and edge information
    for(int i = 0;i < list_RA.Count;i++){
      int indexN = l.Branches[list_RA[i]][0];
      int indexP = l.Branches[list_RA[i]][1];
      Node n = g.addNodeFromPoints(indexN, v, false);
      Node p = g.addNodeFromPoints(indexP, v, true);
      Edge e = g.addEdge(n, p);
      e.ang_GP = ang_GP[i];
      e.spread[0] = RA_Faces.Branches[i][0];
      e.spread[1] = RA_Faces.Branches[i][1];
    }

    //A = g;
    List<Node> nodes = g.nodes;
    List<Edge> edges = g.edges;


    //Graph traversal with each nodes. Getting PList and NList. Getting neighbours of P and N
    foreach(Node n in nodes){
      if(n.isPositive){
        ListP.Add(v[n.index]);
        NodePList.Add(n);
        List<Point3d> sublistP = new List<Point3d>();
        List<Line> sublistEdgeP = new List<Line>();
        foreach(Edge nEdge in n.edges){
          sublistP.Add(v[nEdge.nodeN.index]);
          sublistEdgeP.Add(new Line(nEdge.nodeN.location, nEdge.nodeP.location));
          Point3d adjPt = nEdge.nodeN.location;
          double key = Math.Atan2(adjPt.Y - n.location.Y, adjPt.X - n.location.X);
          n.adjNodes.Add(key, nEdge.nodeN);
        }
        PNeigh.Add(sublistP);
        ListEdgeP.Add(sublistEdgeP);
      }
      if(!n.isPositive){
        ListN.Add(v[n.index]);
        NodeNList.Add(n);
        List<Point3d> sublistN = new List<Point3d>();
        List<Line> sublistEdgeN = new List<Line>();
        foreach(Edge nEdge in n.edges){
          sublistN.Add(v[nEdge.nodeP.index]);
          sublistEdgeN.Add(new Line(nEdge.nodeN.location, nEdge.nodeP.location));
          Point3d adjPt = nEdge.nodeP.location;
          double key = -Math.Atan2(adjPt.Y - n.location.Y, adjPt.X - n.location.X);
          n.adjNodes.Add(key, nEdge.nodeP);
        }
        NNeigh.Add(sublistN);
        ListEdgeN.Add(sublistEdgeN);
      }
    }

    //Add Corner attribute to P
    for(int i = 0;i < NodePList.Count;i++){
      Node p = NodePList[i];
      for (int k = 0; k < l.BranchCount; k++)
      {
        if (l.Branches[k][0] == p.index && isOnGround[l.Branches[k][1]]){
          Point3d corner = v[l.Branches[k][1]];
          double key = Math.Atan2(corner.Y - p.location.Y, corner.X - p.location.X);
          p.cornerIndex.Add(key, l.Branches[k][1]);
          p.corners.Add(key, corner);
        }
      }//Initialize sortedList for node.corners

      int length = p.corners.Count;
      double uKey = p.corners.Keys[length - 1] - Math.PI * 2;
      Point3d uCorner = p.corners.Values[length - 1];
      int uCornerIndex = p.cornerIndex.Values[length - 1];//Prepare for potential cornerList shift

      Vector3d j11 = p.adjNodes.Values[0].location - p.location;
      Vector3d j12 = p.corners.Values[0] - p.location;
      double j21 = Math.Atan2(j11.Y, j11.X);
      double j22 = Math.Atan2(j12.Y, j12.X);
      if(j22 > j21){
        p.corners.RemoveAt(length - 1);
        p.corners.Add(uKey, uCorner);
        p.cornerIndex.Add(uKey, uCornerIndex);
      }//Check if the cornerList of this Node need to be shifted one
    }

    //Add Corner attribute to N
    for(int i = 0;i < NodeNList.Count;i++){
      Node n = NodeNList[i];
      for (int k = 0; k < l.BranchCount; k++)
      {
        if (l.Branches[k][0] == n.index && isOnGround[l.Branches[k][1]]){
          Point3d corner = v[l.Branches[k][1]];
          double key = -Math.Atan2(corner.Y - n.location.Y, corner.X - n.location.X);
          n.cornerIndex.Add(key, l.Branches[k][1]);
          n.corners.Add(key, corner);
        }
      }//Initialize sortedList for node.corners

      int length = n.corners.Count;
      double uKey = n.corners.Keys[length - 1] - Math.PI * 2;
      Point3d uCorner = n.corners.Values[length - 1];
      int uCornerIndex = n.cornerIndex.Values[length - 1];//Prepare for potential cornerList shift

      Vector3d j11 = n.adjNodes.Values[0].location - n.location;
      Vector3d j12 = n.corners.Values[0] - n.location;
      double j21 = Math.Atan2(j11.Y, j11.X);
      double j22 = Math.Atan2(j12.Y, j12.X);
      if(j22 < j21){
        n.corners.RemoveAt(length - 1);
        n.corners.Add(uKey, uCorner);
        n.cornerIndex.Add(uKey, uCornerIndex);
      }//Check if the cornerList of this Node need to be shifted one
    }

    startIndex = g.getStartNode().index;
    Node startNd = g.getStartNode();
    //Node startNd = g.findNode(start);

    //Graph traversal with generations; update node DoFs
    g.ResetDoF();
    List<List<Node>> traversalList = g.traverseNode(startNd);
    DataTree<int> traversalIndexTree = new DataTree<int>();
    DataTree<int> traversalDOFTree = new DataTree<int>();


    //Tree construction for traversal node index
    for(int i = 0; i < traversalList.Count;i++){
      for(int j = 0;j < traversalList[i].Count;j++){
        traversalIndexTree.Add(traversalList[i][j].index, new GH_Path(i));
      }
    }
    //Tree construction for traversal node DoFs
    for(int i = 0; i < traversalList.Count;i++){
      for(int j = 0;j < traversalList[i].Count;j++){
        traversalDOFTree.Add(traversalList[i][j].DoF, new GH_Path(i));
      }
    }

    List<List<Point3d>> cornerList = new List<List<Point3d>>();
    List<List<Point3d>> adjNodeList = new List<List<Point3d>>();
    DataTree<Point3d> cornerTree = new DataTree<Point3d>();
    DataTree<Point3d> adjNodeTree = new DataTree<Point3d>();

    foreach(List<Node> sublistN in traversalList){
      foreach(Node nn in sublistN){
        List<Point3d> cornerSub = nn.corners.Values.ToList();
        List<Node> NodeSub = nn.adjNodes.Values.ToList();
        List<Point3d> adjNodeSub = NodeSub.Select(n => n.location).ToList();
        cornerList.Add(cornerSub);
        adjNodeList.Add(adjNodeSub);
      }
    }
    for(int i = 0; i < cornerList.Count;i++){
      for(int j = 0;j < cornerList[i].Count;j++){
        cornerTree.Add(cornerList[i][j], new GH_Path(i));
      }
    }
    for(int i = 0; i < adjNodeList.Count;i++){
      for(int j = 0;j < adjNodeList[i].Count;j++){
        adjNodeTree.Add(adjNodeList[i][j], new GH_Path(i));
      }
    }

    corners = cornerTree;
    adjNodes = adjNodeTree;


    List<List<Vector3d>> hinsList = new List<List<Vector3d>>();
    List<List<Vector3d>> pitsList = new List<List<Vector3d>>();
    DataTree<Vector3d> hinsTree = new DataTree<Vector3d>();
    DataTree<Vector3d> pitsTree = new DataTree<Vector3d>();

    //Test for the 1st rotation node
    List<Vector3d> startFosum = g.getFosumStart(startNd, tilt);
    hinsList.Add(startNd.hins);
    pitsList.Add(startNd.pits);
    //List<Node> PIteration01 = traversalList[1];
    //List<Node> PIteration02 = traversalList[2];
    int iterationTotal = traversalList.Count;

    List<List<Node>> subTraversal = traversalList.GetRange(1, iterationTotal - 1);
    List<Node> nakedNodes = g.getNakedNodes();
    //C = nakedNodes.Select(n => n.location);

    foreach(List<Node> sublist in subTraversal){
      foreach(Node nn in sublist){
        g.getPyramidP(nn);
        hinsList.Add(nn.hins);
        pitsList.Add(nn.pits);
      }
    }//Add pit and hin list

    //make naked node link
    List<Node> nakedCorner = new List<Node>();
    foreach(Node n in nakedNodes){
      if(n.corners.Count > 2){
        nakedCorner.Add(n);
      }
    }//turning corners in naked nodes. Those corners have two calculated adjNodes
    //C = nakedCorner.Select(n => n.location);
    List<Point3d> nakedHins = new List<Point3d>();
    foreach(Node nc in nakedNodes){
      g.getPyramidNaked(nc);
      foreach(Vector3d hinP in nc.pits){
        nakedHins.Add((Point3d) hinP);
      }
      foreach(Vector3d hinP in nc.hins){
        nakedHins.Add((Point3d) hinP);
      }
    }
    //C = nakedHins;


    // Nexor part
    List<Line> hinges = new List<Line>();
    List<Line> pits = new List<Line>();
    List<Line> temps = new List<Line>();
    List<Line> anchors = new List<Line>();
    List<Polyline> gap_d = new List<Polyline>();
    List<Polyline> gap_u = new List<Polyline>();
    List<Polyline> o_gap_d = new List<Polyline>();
    List<Polyline> o_gap_u = new List<Polyline>();

    List<List<Line>> nexorList = new List<List<Line>>();
    DataTree<Line> nexorTree = new DataTree<Line>();

    g.addHinPitLines();
    g.addAnchorLines();
    Graph g2 = new Graph(g);
    //g.getNexors();
    List<List<Node>> faceList = g2.faces;
    g.updateHinPit(i_base);
    g.addEdgeGapPolyline(-height, offset);
    foreach(Node n in g.nodes){
      for(int i = 0;i < n.hinLns.Count;i++){
        hinges.Add(n.hinLns[i]);
        pits.Add(n.pitLns[i]);
      }
    }
    foreach(Edge e in g.edges){
      temps.Add(e.anchor);
      anchors.Add(e.mirror);
      anchors.Add(e.axis);
      gap_d.Add(e.gap_d);
      gap_u.Add(e.gap_u);
      o_gap_d.Add(e.o_gap_d);
      o_gap_u.Add(e.o_gap_u);
    }
    hn = hinges;
    pn = pits;
    deformation = temps;
    structure = anchors;
    A = gap_d;
    B = gap_u;
    C = o_gap_d;
    D = o_gap_u;

    //Construct model with height
    Volume model = new Volume(g2, 0.0, height);
    nexorList = g.getNexors();
    //List<List<Node>> faceList = g.faces;
    DataTree<Point3d> faceTree = new DataTree<Point3d>();
    //foreach(Node n in model.nodes){
    //  for(int i = 0;i < n.hinLns.Count;i++){
    //    hinges.Add(n.hinLns[i]);
    //    pits.Add(n.pitLns[i]);
    //  }
    //}

    //foreach(Edge e in g.edges){
    //  temps.Add(e.anchor);
    //  anchors.Add(e.mirror);
    //}
    //List<Edge> nakedEdge = g.getNakedEdges();
    //nexor = nakedEdge.Select(e => e.toLine());;
    //console.log(g.getNakedEdges());

    //Tree construction for HinsList
    for(int i = 0; i < hinsList.Count;i++){
      for(int j = 0;j < hinsList[i].Count;j++){
        hinsTree.Add(hinsList[i][j], new GH_Path(i));
      }
    }
    //Tree construction for PitsList
    for(int i = 0; i < pitsList.Count;i++){
      for(int j = 0;j < pitsList[i].Count;j++){
        pitsTree.Add(pitsList[i][j], new GH_Path(i));
      }
    }

    for(int i = 0; i < nexorList.Count;i++){
      for(int j = 0;j < nexorList[i].Count;j++){
        nexorTree.Add(nexorList[i][j], new GH_Path(i));
      }
    }

    //Tree construction for facesList
    for(int i = 0; i < faceList.Count;i++){
      for(int j = 0;j < faceList[i].Count;j++){
        faceTree.Add(faceList[i][j].location, new GH_Path(i));
      }
    }

    N = ListN;
    P = ListP;
    F = faceTree;
    nexor = nexorTree;

    traversal = traversalIndexTree;
    DoFs = traversalDOFTree;
# ---------- graph_of_nodes: C# additional code ----------
  class Node{
    public int index;
    public Point3d location;
    public bool isPositive = false;
    public Point3d pivot;
    public List<Edge> edges = new List<Edge>();
    //public List<int> cornerIndex = new List<int>();
    public SortedList<double,int> cornerIndex = new SortedList<double,int>();
    public SortedList<double,Point3d> corners = new SortedList<double,Point3d>();
    //public SortedList<double,int> adjNodeIndex = new SortedList<double,int>();
    public SortedList<double,Node> adjNodes = new SortedList<double,Node>();
    public int DoF = 3;
    public List<Vector3d> hins = new List<Vector3d>();
    public List<Vector3d> pits = new List<Vector3d>();
    public List<Line> hinLns = new List<Line>();
    public List<Line> pitLns = new List<Line>();

    public List<Node> getAdjacentNode(){
      List<Node> adj = new List<Node>();
      if(this.isPositive){
        foreach(Edge PEdges in this.edges){
          adj.Add(PEdges.nodeN);
        }
      }
      if(!this.isPositive){
        foreach(Edge NEdges in this.edges){
          adj.Add(NEdges.nodeP);
        }
      }
      return adj;
    }
  }

  class Edge{
    public Node nodeN;
    public Node nodeP;
    public double ang_GP;
    public Mesh[] spread = new Mesh[2];
    public Line toLine(){
      return new Line(nodeN.location, nodeP.location);
    }

    public Line anchor = new Line();
    public Line mirror = new Line();
    public Line axis = new Line();
    public Polyline gap_u = new Polyline();
    public Polyline gap_d = new Polyline();
    public Polyline o_gap_u = new Polyline();
    public Polyline o_gap_d = new Polyline();
  }

  class Graph{
    //fields
    public List<Node> nodes = new List<Node>();
    public List<Edge> edges = new List<Edge>();
    public List<List<Node>> faces = new List<List<Node>>();

    //constructor default
    public Graph(){
      nodes = new List<Node>();
      edges = new List<Edge>();
      faces = new List<List<Node>>();
    }

    //copy constructor
    public Graph(Graph g){
      nodes = g.nodes;
      edges = g.edges;
      faces = g.faces;
    }

    //building functions
    public Node addNodeFromPoints(int index, List<Point3d> v, bool isPositive){
      Node existing = findNode(index);
      if(existing != null) return existing;

      Node n = new Node();
      n.index = index;
      n.location = v[index];
      n.isPositive = isPositive;
      nodes.Add(n);
      return n;
    }

    public Node addNode(Point3d p, bool isPositive){
      Node n = new Node();
      n.location = p;
      n.isPositive = isPositive;
      nodes.Add(n);
      return n;
    }

    public Node findNode(int index){
      foreach(Node n in nodes){
        if(n.index == index) return n;
      }
      return null;
    }

    public Edge addEdge(Node n1, Node n2){
      if(n1 == n2) return null;

      Edge existing = findEdge(n1, n2);
      if(existing != null) return existing;

      Edge e = new Edge();
      e.nodeN = n1;
      e.nodeP = n2;

      n1.edges.Add(e);
      n2.edges.Add(e);

      edges.Add(e);
      return e;
    }

    public Edge findEdge(Node n1, Node n2){
      foreach(Edge e in edges){
        if(e.nodeN == n1 && e.nodeP == n2) return e;
      }

      return null;
    }

    public Edge findEdgeNoDir(Node n1, Node n2){
      foreach(Edge e in edges){
        if((e.nodeN == n1 && e.nodeP == n2) || (e.nodeN == n2 && e.nodeP == n1)) return e;
      }

      return null;
    }

    public Edge findAdjEdgeP(Edge e){
      int count = e.nodeP.adjNodes.Count;
      Node otherNode = e.nodeP.adjNodes.Values[(whereamI(e.nodeN, e.nodeP) + 1) % count];
      return findEdgeNoDir(e.nodeP, otherNode);
    }

    public Edge findAdjEdgeN(Edge e){
      int count = e.nodeN.adjNodes.Count;
      Node otherNode = e.nodeN.adjNodes.Values[(whereamI(e.nodeP, e.nodeN) + 1) % count];
      return findEdgeNoDir(e.nodeN, otherNode);
    }

    public Edge findPair(Edge e){
      return findEdgeNoDir(findAdjEdgeP(e).nodeN, findAdjEdgeN(e).nodeP);
    }


    public void ResetDoF(){
      foreach(Node n in this.nodes){
        n.DoF = 3;
      }
    }

    public Node getStartNode(){
      Point3d total = new Point3d();
      PointCloud nClothedNodes = new PointCloud();
      List<Node> nClothed = new List<Node>();
      int k = 0;
      //PointCloud NNodesCloud = new PointCloud(ListN);
      for(int i = 0;i < nodes.Count;i++){
        total += nodes[i].location;
        if((!isNaked(nodes[i])) && (!nodes[i].isPositive)){
          nClothedNodes.Add(nodes[i].location);
          nClothed.Add(nodes[i]);
          k++;
        }
      }
      total = total / nodes.Count;
      int startId = nClothedNodes.ClosestPoint(total);
      return nClothed[startId];
    }//Calculate start node based on the average of all nodes. This must be a negative node. This must be a clothed node.

    public List<List<Node>> traverseNode(Node startNode){
      List<List<Node>> traverseNodeList = new List<List<Node>>();
      List<Node> remainingNodes = new List<Node>();
      foreach(Node n in this.nodes){
        if (!isNaked(n)){
          remainingNodes.Add(n);
        }
      }
      int generation = 0;
      List<Node> currentGen = new List<Node>();
      List<Node> calculated = new List<Node>();
      while(remainingNodes.Any()){
        //List<Node> currentGen = new List<Node>();
        List<Node> nextGen = new List<Node>();
        if(generation == 0){
          currentGen.Add(startNode);
          calculated.Add(startNode);
          remainingNodes.Remove(startNode);
          foreach(Node ni in startNode.getAdjacentNode()){
            if(!isNaked(ni)){
              nextGen.Add(ni);
              ni.DoF -= 1;
            }
          }
          //nextGen = startNode.getAdjacentNode();
          //foreach(Node n in nextGen){
          //  n.DoF -= 1;
          //}
        }
        else{
          foreach(Node n in currentGen){
            List<Node> adjNode = n.getAdjacentNode();
            foreach(Node ni in adjNode){
              bool alreadyCalculated = calculated.Contains(ni);
              bool alreadyAddedNext = nextGen.Contains(ni);
              if(!alreadyCalculated && !alreadyAddedNext && !isNaked(ni)){
                nextGen.Add(ni);
                ni.DoF -= 1;
              }
              if(alreadyAddedNext){
                ni.DoF -= 1;
              }
            }
            calculated.Add(n);
            remainingNodes.Remove(n);
          }
        }
        traverseNodeList.Add(currentGen);
        currentGen = new List<Node>(nextGen);
        generation += 1;
      }
      return traverseNodeList;
    }//Traverse all the clothed nodes && update dof


    public List<Vector3d> getFosumStart(Node startN, double tilt){
      //List<Vector3d> pyramidDir = new List<Vector3d>();
      Vector3d pivotN = new Vector3d(0, 0, -1);
      List<Vector3d> cornerN = new List<Vector3d>();
      List<Vector3d> biseN = new List<Vector3d>();
      foreach(Point3d icorners in startN.corners.Values){
        Vector3d thisCornerN = (icorners - startN.location);
        thisCornerN.Unitize();
        cornerN.Add(thisCornerN);
        Vector3d thisBiseN = thisCornerN - pivotN;
        biseN.Add(thisBiseN);
      }//initialize reference triangles and bisect normals

      Vector3d hinN = new Vector3d();
      Vector3d pitN = new Vector3d();

      for(int k = 0;k < cornerN.Count;k++){
        //Vector3d hinN = new Vector3d();
        if(k == 0){
          Vector3d x2 = Vector3d.CrossProduct(pivotN, biseN[k]);
          x2.Unitize();
          Vector3d x1 = Vector3d.CrossProduct(biseN[k], x2);
          x1.Unitize();
          hinN = Math.Cos(tilt) * x1 + Math.Sin(tilt) * x2;
          Vector3d vecI = hinpitP(startN, hinN);
          //pyramidDir.Add(vecI);
          startN.hins.Add(vecI);
        }
        else{
          Vector3d x3 = startN.adjNodes.Values[k - 1].location - startN.location;
          Vector3d x2 = Vector3d.CrossProduct(x3, hinN);
          x2.Unitize();
          Vector3d x1 = Vector3d.CrossProduct(x2, x3);
          x1.Unitize();
          double ang = findEdgeNoDir(startN.adjNodes.Values[k - 1], startN).ang_GP;
          x3.Unitize();
          pitN = (hinN * x1) * (Math.Cos(ang) * x1 - Math.Sin(ang) * x2) + (hinN * x3) * x3;
          Vector3d vecJ = (Vector3d) startN.location - pitN / pitN.Z * startN.location.Z;
          startN.pits.Add(vecJ);
          Vector3d vec2 = Math.Cos(ang / 2) * x2 + Math.Sin(ang / 2) * x1;
          hinN = -Vector3d.CrossProduct(biseN[k], vec2);
          Vector3d vecI = hinpitP(startN, hinN);
          startN.hins.Add(vecI);
        }
      }
      Node lastNode = startN.adjNodes.Values.Last();
      Vector3d x3W = lastNode.location - startN.location;
      Vector3d x2W = Vector3d.CrossProduct(x3W, hinN);
      x2W.Unitize();
      Vector3d x1W = Vector3d.CrossProduct(x2W, x3W);
      x1W.Unitize();
      double angW = findEdgeNoDir(lastNode, startN).ang_GP;
      x3W.Unitize();
      pitN = hinN * x1W * (Math.Cos(angW) * x1W - Math.Sin(angW) * x2W) + (hinN * x3W) * x3W;
      Vector3d vecJW = hinpitP(startN, pitN);
      startN.pits.Add(vecJW);
      int countPit = startN.pits.Count - 1;
      Vector3d lastpit = startN.pits[countPit];
      startN.pits.RemoveAt(countPit);
      startN.pits.Insert(0, lastpit);

      return startN.hins;
    }//Add pits and hins for the start node

    public int whereamI(Node me, Node neighbour){
      if(!neighbour.adjNodes.Values.Contains(me)){
        throw new System.ArgumentException("Node should be neighbourhood", "neighbour");
      }
      return neighbour.adjNodes.IndexOfValue(me);
    }//Returns the index of current node in its neighbours' adjNode SortedList

    public List<Vector3d> getPyramidP(Node nodeP){

      //ReCheck DoF of the node and get the calculated neighbouring nodes
      List<Node> calcNeighList = new List<Node>();
      List<int> seedIndex = new List<int>();//store which neighbour of this node is calculated
      for(int i = 0;i < nodeP.adjNodes.Count;i++){
        if(nodeP.adjNodes.Values[i].hins.Any()){
          calcNeighList.Add(nodeP.adjNodes.Values[i]);
          seedIndex.Add(i);
        }
      }
      Vector3d[] thisHins = new Vector3d[nodeP.corners.Count];
      Vector3d[] thisPits = new Vector3d[nodeP.corners.Count];

      List<Vector3d> cornerN = new List<Vector3d>();
      List<Vector3d> biseN = new List<Vector3d>();
      Vector3d hinN = new Vector3d();
      Vector3d pitN = new Vector3d();
      Vector3d pivotN = new Vector3d(0, 0, -1);
      Vector3d p = (Vector3d) nodeP.location;
      int k = 0;//k will be the index of seed

      foreach(Point3d icorners in nodeP.corners.Values){
        Vector3d thisCornerN = (Vector3d) icorners - p;
        thisCornerN.Unitize();
        cornerN.Add(thisCornerN);
      }//Get corner normal

      //Case: DoF of 1
      if(calcNeighList.Count == 2){
        Node n1 = seedIndex[1] - seedIndex[0] == 1 ? calcNeighList[0] : calcNeighList[1];
        Node n2 = seedIndex[1] - seedIndex[0] == 1 ? calcNeighList[1] : calcNeighList[0];
        if(seedIndex[1] - seedIndex[0] != 1){
          seedIndex.Reverse();
        }//in case for seedIndex:[1,4],will change it to [4,1]

        int n1Count = n1.hins.Count;
        int index1 = ((whereamI(nodeP, n1) + 1) % n1Count);//to be checked
        int index2 = whereamI(nodeP, n2);
        Vector3d refPt1 = n1.hins[index1];
        Vector3d refPt2 = n2.hins[index2];//Prepare steps

        //get the first hinge
        Vector3d vec1 = (Vector3d) n1.location - p;
        Vector3d x1 = Vector3d.CrossProduct(vec1, refPt1 - p);//normal of mirror plane1
        x1.Unitize();
        Vector3d vec2 = (Vector3d) n2.location - p;
        Vector3d x2 = Vector3d.CrossProduct(vec2, refPt2 - p);
        x2.Unitize();//normal of mirror plane2
        hinN = -Vector3d.CrossProduct(x1, x2);//intersection between two planes, aka normal of the first hinge

        k = seedIndex[1];
        Vector3d hinsP = hinpitP(nodeP, hinN);
        thisHins[k] = hinsP;

        //find the pivot
        hinN.Unitize();
        vec1 = Vector3d.CrossProduct(hinN, pivotN);
        vec1.Unitize();
        vec2 = Vector3d.CrossProduct(vec1, hinN);
        Vector3d j1 = new Vector3d(cornerN[k] * hinN, cornerN[k] * vec1, cornerN[k] * vec2);
        vec1 = Vector3d.CrossProduct(hinN, cornerN[k]);
        vec1.Unitize();
        vec2 = Vector3d.CrossProduct(vec1, hinN);
        Vector3d j2 = new Vector3d(j1.X, -j1.Y, j1.Z);
        Vector3d tempX = new Vector3d(hinN.X, vec1.X, vec2.X);
        Vector3d tempY = new Vector3d(hinN.Y, vec1.Y, vec2.Y);
        Vector3d tempZ = new Vector3d(hinN.Z, vec1.Z, vec2.Z);
        pivotN = new Vector3d(j2 * tempX, j2 * tempY, j2 * tempZ);//Set pivotN
        nodeP.pivot = (Point3d) hinpitP(nodeP, pivotN);
        for(int i = 0;i < cornerN.Count;i++){
          Vector3d thisBise = cornerN[i] - pivotN;
          thisBise.Unitize();
          biseN.Add(thisBise);
        }//SetList: biseN
      }

      else if(calcNeighList.Count == 1){
        Node n0 = calcNeighList[0];
        Vector3d refPt = n0.hins[whereamI(nodeP, n0)];
        nodeP.pivot = (Point3d) hinpitP(nodeP, pivotN);
        //generating the normal vector of bisector
        for(int i = 0;i < cornerN.Count;i++){
          Vector3d thisBise = cornerN[i] - pivotN;
          thisBise.Unitize();
          biseN.Add(thisBise);
        }//SetList:biseN

        //generating rotating polygon
        k = seedIndex[0];
        Vector3d vec1 = (Vector3d) n0.location - p;
        Vector3d vec2 = refPt - p;
        Vector3d x2 = Vector3d.CrossProduct(vec1, vec2);
        x2.Unitize();
        hinN = -Vector3d.CrossProduct(biseN[k], x2);
        Vector3d hinsP = hinpitP(nodeP, hinN); //p - hinN / hinN.Z * p.Z;
        thisHins[k] = hinsP;
      }

      //Sorting hins and pits accordingly
      int nCount = nodeP.adjNodes.Count;
      for(int i = k + 1;i < k + nCount;i++){
        Vector3d vec1 = (Vector3d) nodeP.adjNodes.Values[(i - 1) % nCount].location - p;
        Vector3d x2 = Vector3d.CrossProduct(vec1, hinN);//x2: normal of mirror plane at edge[i-1]
        x2.Unitize();
        Vector3d x1 = Vector3d.CrossProduct(x2, vec1);//x1: x direction of mirror plane
        x1.Unitize();
        vec1.Unitize();
        double ang = findEdgeNoDir(nodeP, nodeP.adjNodes.Values[(i - 1) % nCount]).ang_GP;
        int judge = nodeP.isPositive ? 1 : -1;
        pitN = (hinN * x1) * (Math.Cos(ang) * x1 + judge * Math.Sin(ang) * x2) + (hinN * vec1) * vec1;
        thisPits[i % nCount] = hinpitP(nodeP, pitN);
        Vector3d vec2 = Math.Cos(ang / 2) * x2 - judge * Math.Sin(ang / 2) * x1;
        hinN = -Vector3d.CrossProduct(biseN[i % nCount], vec2);
        thisHins[i % nCount] = hinpitP(nodeP, hinN);
      }
      //Sorting the remaining pit
      k = k + nCount;
      pitN = getPitN(nodeP, k, hinN);
      thisPits[k % nCount] = hinpitP(nodeP, pitN);

      nodeP.hins = thisHins.ToList();
      nodeP.pits = thisPits.ToList();

      return nodeP.hins;
    }//Add pits and hins for any clothed node

    public List<Vector3d> getPyramidNaked(Node nodeNaked){
      List<Node> calcNeighList = new List<Node>();
      List<int> seedIndex = new List<int>();//store which neighbour of this node is calculated
      for(int i = 0;i < nodeNaked.adjNodes.Count;i++){
        if(!isNaked(nodeNaked.adjNodes.Values[i]) && nodeNaked.adjNodes.Values[i].hins.Any()){
          calcNeighList.Add(nodeNaked.adjNodes.Values[i]);
          seedIndex.Add(i);//seedIndex = [0] or [0,1]
        }
      }
      Vector3d[] thisHins = new Vector3d[nodeNaked.corners.Count];
      Vector3d[] thisPits = new Vector3d[nodeNaked.adjNodes.Count + 1];
      List<Vector3d> cornerN = new List<Vector3d>();
      List<Vector3d> biseN = new List<Vector3d>();
      Vector3d hinN = new Vector3d();
      Vector3d pivotN = new Vector3d(0, 0, -1);
      Vector3d p = (Vector3d) nodeNaked.location;
      int k = 0;//k will be the index of seed, will be reset later

      foreach(Point3d icorners in nodeNaked.corners.Values){
        Vector3d thisCornerN = (Vector3d) icorners - p;
        thisCornerN.Unitize();
        cornerN.Add(thisCornerN);
      }//Get corner normal

      //Case: concave naked corner. two of its neighbour are calculted
      if(calcNeighList.Count == 2){
        int mod = nodeNaked.corners.Count;
        bool needReverse = nodeNaked.adjNodes.Keys[1] - nodeNaked.adjNodes.Keys[0] > Math.PI;
        Node n1 = !needReverse ? calcNeighList[0] : calcNeighList[1];//n1 corresponding to k
        Node n2 = !needReverse ? calcNeighList[1] : calcNeighList[0];//n2 corresponsing to k+1
        if(needReverse){
          seedIndex.Reverse();
        }//in case for seedIndex:[0,1] will change it to [1,0]
        hinN = gethinN(n1, n2, nodeNaked);
        k = getK(nodeNaked);// starting corner index
        pivotN = getPivotN(nodeNaked, hinN, pivotN, seedIndex);
        nodeNaked.pivot = (Point3d) hinpitP(nodeNaked, pivotN);
        thisHins[(k + mod) % mod] = hinpitP(nodeNaked, hinN);
        for(int i = 0;i < cornerN.Count;i++){
          Vector3d thisBise = cornerN[i] - pivotN;
          thisBise.Unitize();
          biseN.Add(thisBise);
        }//SetList: biseN

        int k1 = k + 1;
        Vector3d RA1 = n2.location - nodeNaked.location;
        double ang1 = findEdgeNoDir(nodeNaked, n2).ang_GP;
        Vector3d pitN1 = getMirroredPitN(RA1, nodeNaked.isPositive, hinN, ang1);
        thisPits[(k1 + mod) % mod] = hinpitP(nodeNaked, pitN1);
        Vector3d hinN1 = getMirrorHinN(nodeNaked.isPositive, ang1, RA1, hinN, biseN[(k1 - 1 + mod) % mod]);
        thisHins[(k1 + mod) % mod] = hinpitP(nodeNaked, hinN1);

        int k2 = k - 1;
        Vector3d RA2 = n1.location - nodeNaked.location;
        double ang2 = findEdgeNoDir(nodeNaked, n1).ang_GP;
        Vector3d hinN2 = getMirrorHinN(!nodeNaked.isPositive, ang2, RA2, hinN, biseN[(k2 - 1 + mod) % mod]);
        thisHins[(k2 + mod) % mod] = hinpitP(nodeNaked, hinN2);
        thisPits[(k2 + mod) % mod] = thisHins[(k2 + mod) % mod];
        Transform t1 = Transform.Mirror(new Plane(nodeNaked.location, Vector3d.CrossProduct(hinN, RA2)));
        hinN2.Transform(t1);
        thisPits[(k + mod) % mod] = hinpitP(nodeNaked, hinN2);
      }

      else if(calcNeighList.Count == 1){
        Node na = calcNeighList[0];
        Vector3d RA = na.location - nodeNaked.location;
        hinN = getEdgeAnchorHin(nodeNaked, na, pivotN);
        hinN.Unitize();
        thisHins[0] = hinpitP(nodeNaked, hinN);//hinge at hinge plane
        thisPits[0] = thisHins[0];

        int naCount = na.hins.Count;
        Point3d refPt = (Point3d) na.hins[(whereamI(nodeNaked, na) + 1) % naCount];
        Vector3d vec1 = refPt - na.location;
        Vector3d x2 = Vector3d.CrossProduct(vec1, RA);//normal direction of the plane
        x2.Unitize();//
        Transform t2 = Transform.Mirror(new Plane(nodeNaked.location, x2));
        hinN.Transform(t2);
        thisPits[1] = hinpitP(nodeNaked, hinN);

        double ang = findEdgeNoDir(nodeNaked, na).ang_GP / 2;
        hinN = getEdgeMirrorHin(nodeNaked, na, pivotN, ang);
        thisHins[1] = hinpitP(nodeNaked, hinN);
      }

      nodeNaked.hins = thisHins.ToList();
      nodeNaked.pits = thisPits.ToList();
      return nodeNaked.hins;
    }//Add pits and hins for any naked node

    //A series of assisting function for getPyramidP
    private Vector3d getPitN(Node nodeP, int k, Vector3d hinN){
      Vector3d x3W = (Vector3d) nodeP.adjNodes.Values[(k - 1) % nodeP.adjNodes.Count].location - (Vector3d) nodeP.location;
      Vector3d x2W = Vector3d.CrossProduct(x3W, hinN);
      x2W.Unitize();
      Vector3d x1W = Vector3d.CrossProduct(x2W, x3W);
      x1W.Unitize();
      double angW = findEdgeNoDir(nodeP, nodeP.adjNodes.Values[(k - 1) % nodeP.adjNodes.Count]).ang_GP;
      x3W.Unitize();
      int judge = nodeP.isPositive ? 1 : -1;
      return (hinN * x1W) * (Math.Cos(angW) * x1W + judge * Math.Sin(angW) * x2W) + (hinN * x3W) * x3W;
    }//Get leftover PitN after loop calculation is over

    private Vector3d gethinN(Node n1, Node n2, Node me){
      //n1 provideds mirror, n2 provides hinge
      int n1Count = n1.hins.Count;
      int index1 = ((whereamI(me, n1) + 1) % n1Count);
      int index2 = whereamI(me, n2);
      Point3d refPt1 = (Point3d) n1.hins[index1];
      Point3d refPt2 = (Point3d) n2.hins[index2];
      Vector3d vec1 = n1.location - me.location;
      Vector3d x1 = Vector3d.CrossProduct(vec1, refPt1 - me.location);//normal of mirror plane
      x1.Unitize();
      Vector3d vec2 = n2.location - me.location;
      Vector3d x2 = Vector3d.CrossProduct(vec2, refPt2 - me.location);
      x2.Unitize();//normal of hinge plane
      return -Vector3d.CrossProduct(x1, x2);//intersection between two planes, aka normal of the first hinge
    }// Return the first hinN if two of this node's neighbour is calculated

    private int getK(Node n){
      List<Vector3d> cornerN = new List<Vector3d>();
      Point3d total = new Point3d();
      foreach(Point3d icorners in n.corners.Values){
        Vector3d thisCornerN = icorners - n.location;
        thisCornerN.Unitize();
        cornerN.Add(thisCornerN);
        total += icorners;
      }
      total = total / n.corners.Count;
      PointCloud cloud = new PointCloud(n.corners.Values);
      int kNaked = cloud.ClosestPoint(total);
      return  (kNaked + 1) % cornerN.Count ;
    }// get the starting index for a naked node whose two of this node's neighbour is calculated

    private Vector3d getMirroredPitN(Vector3d RA, bool isPositive, Vector3d hinN, double ang){
      Vector3d vec1 = RA;
      Vector3d x2 = Vector3d.CrossProduct(vec1, hinN);//x2: normal of mirror plane at edge[i-1]
      x2.Unitize();
      Vector3d x1 = Vector3d.CrossProduct(x2, vec1);//x1: x direction of mirror plane
      x1.Unitize();
      vec1.Unitize();
      int judge = isPositive ? 1 : -1;
      return (hinN * x1) * (Math.Cos(ang) * x1 + judge * Math.Sin(ang) * x2) + (hinN * vec1) * vec1;
    }// get a pitN based on rotation axis(from this node to adjNode),an existing hinN and the angle gap to mirror

    private Vector3d getMirrorHinN(bool isPositive, double ang, Vector3d RA, Vector3d hinN, Vector3d biseN){
      Vector3d vec1 = RA;
      Vector3d x2 = Vector3d.CrossProduct(vec1, hinN);//x2: normal of mirror plane at edge[i-1]
      x2.Unitize();
      Vector3d x1 = Vector3d.CrossProduct(x2, vec1);//x1: x direction of mirror plane
      x1.Unitize();
      int judge = isPositive ? 1 : -1;
      Vector3d vec2 = Math.Cos(ang / 2) * x2 - judge * Math.Sin(ang / 2) * x1;
      return -Vector3d.CrossProduct(biseN, vec2);
    }// get a hinN based on mirror axis,

    private Vector3d getEdgeAnchorHin(Node me, Node na, Vector3d pivotN){
      Vector3d RA = na.location - me.location;
      Point3d refPt = (Point3d) na.hins[whereamI(me, na)];
      Vector3d vec1 = refPt - na.location;
      Vector3d x2 = Vector3d.CrossProduct(vec1, RA);//normal direction of the plane
      x2.Unitize();//
      Vector3d ihat = Vector3d.CrossProduct(pivotN, x2);
      ihat.Unitize();
      Vector3d jhat = Vector3d.CrossProduct(x2, ihat);
      jhat.Unitize();
      double ang = 0;
      return Math.Cos(ang) * jhat - Math.Sin(ang) * ihat;
    }

    private Vector3d getEdgeMirrorHin(Node me, Node na, Vector3d pivotN, double ang){
      int naCount = na.hins.Count;
      Vector3d RA = na.location - me.location;
      Point3d refPt = (Point3d) na.hins[(whereamI(me, na) + 1) % naCount];
      Vector3d vec1 = refPt - na.location;
      Vector3d x2 = Vector3d.CrossProduct(vec1, RA);//normal direction of the plane
      x2.Unitize();//
      Vector3d ihat = Vector3d.CrossProduct(pivotN, x2);
      ihat.Unitize();
      Vector3d jhat = Vector3d.CrossProduct(x2, ihat);
      jhat.Unitize();
      Vector3d hinN = Math.Cos(ang) * jhat + Math.Sin(ang) * ihat;
      hinN.Unitize();
      return hinN;
    }

    private Vector3d getPivotN(Node n, Vector3d hinN, Vector3d pivotN, List<int> seedIndex){
      List<Vector3d> cornerN = new List<Vector3d>();
      Point3d total = new Point3d();
      foreach(Point3d icorners in n.corners.Values){
        Vector3d thisCornerN = icorners - n.location;
        thisCornerN.Unitize();
        cornerN.Add(thisCornerN);
        total += icorners;
      }
      total = total / n.corners.Count;
      PointCloud cloud = new PointCloud(n.corners.Values);
      int kNaked = cloud.ClosestPoint(total);
      int k = isNaked(n) ? (kNaked + 1) % cornerN.Count : seedIndex[1];
      hinN.Unitize();
      Vector3d vec1 = Vector3d.CrossProduct(hinN, pivotN);
      vec1.Unitize();
      Vector3d vec2 = Vector3d.CrossProduct(vec1, hinN);
      Vector3d j1 = new Vector3d(cornerN[k] * hinN, cornerN[k] * vec1, cornerN[k] * vec2);
      vec1 = Vector3d.CrossProduct(hinN, cornerN[k]);
      vec1.Unitize();
      vec2 = Vector3d.CrossProduct(vec1, hinN);
      Vector3d j2 = new Vector3d(j1.X, -j1.Y, j1.Z);
      Vector3d tempX = new Vector3d(hinN.X, vec1.X, vec2.X);
      Vector3d tempY = new Vector3d(hinN.Y, vec1.Y, vec2.Y);
      Vector3d tempZ = new Vector3d(hinN.Z, vec1.Z, vec2.Z);
      return new Vector3d(j2 * tempX, j2 * tempY, j2 * tempZ);//Set pivotN
    }// Return modified pitvotN if two of this node's neighbour is calculated

    private Vector3d hinpitP(Node n, Vector3d hinpitN){
      return (Vector3d) n.location - hinpitN / hinpitN.Z * n.location.Z;
    }//Get the location of hin and pit of a node based on their direction


    public void updateHinPit(double height){
      List<Node> candN = nodes;
      foreach(Node n in candN){
        List<Vector3d> hinN = new List<Vector3d>();
        List<Vector3d> pitN = new List<Vector3d>();
        foreach(Vector3d hin in n.hins){
          Vector3d thisHinN = n.location - (Point3d) hin;
          thisHinN.Unitize();
          hinN.Add(thisHinN);
        }
        foreach(Vector3d pit in n.pits){
          Vector3d thisPitN = n.location - (Point3d) pit;
          thisPitN.Unitize();
          pitN.Add(thisPitN);
        }
        for(int i = 0;i < n.hins.Count;i++){
          Vector3d newHin = n.hins[i] + hinN[i] * (height / hinN[i].Z);
          Vector3d newPit = n.pits[i] + pitN[i] * (height / pitN[i].Z);
          n.hins[i] = newHin;
          n.pits[i] = newPit;
        }
        n.hinLns = new List<Line>();
        n.pitLns = new List<Line>();
      }
      addHinPitLines();
      addAnchorLines();
    }

    public void addHinPitLines(){
      foreach(Node n in this.nodes){
        if(!isNaked(n)){
          int total = n.hins.Count;
          for(int i = 0;i < total;i++){
            Point3d start = (Point3d) n.hins[i];
            Point3d to = (Point3d) n.hins[(i + 1) % total];
            Point3d toPit = (Point3d) n.pits[i];
            n.hinLns.Add(new Line(start, to));
            n.pitLns.Add(new Line(start, toPit));
          }
        }
        else{
          if(n.corners.Count == 2){
            Point3d start = (Point3d) n.hins[1];
            Point3d end = (Point3d) n.hins[0];
            Point3d toPit = (Point3d) n.pits[1];
            n.hinLns.Add(new Line(start, end));
            n.pitLns.Add(new Line(start, toPit));
          }
          else if(n.corners.Count == 3){
            int k = getK(n);
            int mod = n.corners.Count;
            Point3d hin0 = (Point3d) n.hins[(k + mod - 1) % mod];
            Point3d hin1 = (Point3d) n.hins[k % mod];
            Point3d hin2 = (Point3d) n.hins[(k + 1) % mod];
            Point3d pit1 = (Point3d) n.pits[k % mod];
            Point3d pit2 = (Point3d) n.pits[(k + 1) % mod];
            n.hinLns.Add(new Line(hin1, hin0));
            n.hinLns.Add(new Line(hin1, hin2));
            n.pitLns.Add(new Line(hin1, pit1));
            n.pitLns.Add(new Line(hin2, pit2));
          }
        }
      }
    }

    public void addAnchorLines(){
      foreach(Edge e in this.edges){
        if((!isNaked(e.nodeN)) && !isNaked(e.nodeP)){
          Node np = e.nodeP;
          Node nn = e.nodeN;
          int pCount = np.corners.Count;
          int nCount = nn.corners.Count;
          int PinN = whereamI(np, nn);
          int NinP = whereamI(nn, np);
          e.anchor = new Line((Point3d) np.hins[NinP], (Point3d) nn.hins[PinN]);
          e.mirror = new Line((Point3d) np.pits[(NinP + 1) % pCount], (Point3d) nn.pits[(PinN + 1) % nCount]);
          e.axis = new Line((Point3d) np.hins[(NinP + 1) % pCount], (Point3d) nn.hins[(PinN + 1) % nCount]);
        }
        else if(isNaked(e.nodeN) || isNaked(e.nodeP)){
          Node naked = isNaked(e.nodeN) ? e.nodeN : e.nodeP;
          Node clothed = isNaked(e.nodeN) ? e.nodeP : e.nodeN;
          if(naked.corners.Count == 2){
            int count = clothed.corners.Count;
            int index = whereamI(naked, clothed);
            Line anchorLn = new Line((Point3d) clothed.hins[index], (Point3d) naked.hins[0]);
            Line mirrorLn = new Line((Point3d) clothed.pits[(index + 1) % count], (Point3d) naked.pits[1]);
            Line axisLn = new Line((Point3d) clothed.hins[(index + 1) % count], (Point3d) naked.hins[1]);
            if(naked.isPositive){
              anchorLn.Flip();
              mirrorLn.Flip();
              axisLn.Flip();
            }
            e.anchor = anchorLn;
            e.mirror = mirrorLn;
            e.axis = axisLn;
          }
          else{
            int cCount = clothed.corners.Count;
            int nCount = naked.corners.Count;
            int k = getK(naked);
            int NinC = whereamI(naked, clothed);
            List<Node> calcNeighList = new List<Node>();
            for(int i = 0;i < naked.adjNodes.Count;i++){
              calcNeighList.Add(naked.adjNodes.Values[i]);
            }
            int mod = naked.corners.Count;
            Line anchorLn = new Line();
            Line mirrorLn = new Line();
            Line axisLn = new Line();
            bool needReverse = naked.adjNodes.Keys[1] - naked.adjNodes.Keys[0] > Math.PI;
            Node n1 = !needReverse ? calcNeighList[0] : calcNeighList[1];
            Node n2 = !needReverse ? calcNeighList[1] : calcNeighList[0];
            if(clothed.index == n1.index){
              anchorLn = new Line((Point3d) clothed.hins[NinC], (Point3d) naked.hins[((k - 1) + nCount) % nCount]);
              mirrorLn = new Line((Point3d) clothed.pits[(NinC + 1) % cCount], (Point3d) naked.pits[k % nCount]);
              axisLn = new Line((Point3d) clothed.hins[(NinC + 1) % cCount], (Point3d) naked.hins[k % nCount]);
            }
            else if(clothed.index == n2.index){
              anchorLn = new Line((Point3d) clothed.hins[NinC], (Point3d) naked.hins[k % nCount]);
              mirrorLn = new Line((Point3d) clothed.pits[(NinC + 1) % cCount], (Point3d) naked.pits[(k + 1) % nCount]);
              axisLn = new Line((Point3d) clothed.hins[(NinC + 1) % cCount], (Point3d) naked.hins[(k + 1) % nCount]);
            }
            if(naked.isPositive){
              anchorLn.Flip();
              mirrorLn.Flip();
              axisLn.Flip();
            }
            e.anchor = anchorLn;
            e.mirror = mirrorLn;
            e.axis = axisLn;
          }
        }
      }
    }

    public void addEdgeGapPolyline(double thick, double offset){
      foreach(Edge e in this.edges){
        Point3d N = (Point3d) e.nodeN.location;
        Point3d P = (Point3d) e.nodeP.location;
        List<Point3d> hins = new List<Point3d>();hins.Add(e.anchor.PointAt(0.0));hins.Add(e.anchor.PointAt(1.0));
        List<Point3d> pits = new List<Point3d>();pits.Add(e.mirror.PointAt(0.0));pits.Add(e.mirror.PointAt(1.0));
        List<Point3d> anchors = new List<Point3d>();anchors.Add(e.axis.PointAt(0.0));anchors.Add(e.axis.PointAt(1.0));

        List<Point3d> v_u_gap = new List<Point3d>();
        List<Point3d> v_d_gap = new List<Point3d>();
        v_u_gap.Add(hins[0]);v_u_gap.Add(anchors[0]);v_u_gap.AddRange(pits);v_u_gap.Add(anchors[1]);v_u_gap.Add(hins[1]);
        List<Vector3d> vec_P = new List<Vector3d>();
        List<Vector3d> vec_N = new List<Vector3d>();
        for(int i = 0;i < 3;i++){
          Vector3d vec = v_u_gap[i] - P;
          vec_P.Add(vec);
          Point3d dp = v_u_gap[i] - thick * (vec / vec.Z);
          v_d_gap.Add(dp);
        }
        for(int i = 3;i < 6;i++){
          Vector3d vec = v_u_gap[i] - N;
          vec_N.Add(vec);
          Point3d dp = v_u_gap[i] - thick * (vec / vec.Z);
          v_d_gap.Add(dp);
        }
        //v_u_gap.Add(v_u_gap[0]);
        //v_d_gap.Add(v_d_gap[0]);
        e.gap_u = new Polyline(v_u_gap);
        e.gap_d = new Polyline(v_d_gap);

        List<Vector3d> tra = new List<Vector3d>();
        List<Vector3d> Vecs = new List<Vector3d>();
        Vecs.AddRange(vec_P);
        Vecs.AddRange(vec_N);
        List<Vector3d> Norm = new List<Vector3d>();
        for(int i = 0;i < 6;i++){
          Vector3d vec = v_u_gap[(i + 1) % 6] - v_u_gap[i];
          tra.Add(vec);
          Vector3d n = Vector3d.CrossProduct(Vecs[i], vec);
          n.Unitize();
          n = n / Math.Sign(n.Z);
          Norm.Add(n);
        }
        for(int i = 0;i < 6;i++){
          Matrix back = new Matrix(3, 1);
          back[0, 0] = offset;back[1, 0] = offset;back[2, 0] = 0;
          Matrix forward = new Matrix(3, 3);
          forward[0, 0] = Norm[(6 + i - 1) % 6].X;forward[0, 1] = Norm[(6 + i - 1) % 6].Y;forward[0, 2] = Norm[(6 + i - 1) % 6].Z;
          forward[1, 0] = Norm[i].X;forward[1, 1] = Norm[i].Y;forward[1, 2] = Norm[i].Z;
          forward[2, 0] = 0;forward[2, 1] = 0;forward[2, 2] = 1;
          forward.Invert(0);
          Matrix twik = forward * back;
          Vector3d move = new Vector3d(twik[0, 0], twik[1, 0], twik[2, 0]);
          v_u_gap[i] = v_u_gap[i] + move;
        }
        //v_u_gap.Insert(1, anchors[0]);
        //v_u_gap.Insert(6, anchors[1]);
        //v_d_gap.Insert(1, anchors[0]);
        //v_d_gap.Insert(6, anchors[1]);
        for(int i = 0;i < 3;i++){
          Vector3d vec = v_u_gap[i] - P;
          vec_P.Add(vec);
          Point3d dp = v_u_gap[i] - thick * (vec / vec.Z);
          v_d_gap[i] = dp;
        }
        for(int i = 3;i < 6;i++){
          Vector3d vec = v_u_gap[i] - N;
          vec_N.Add(vec);
          Point3d dp = v_u_gap[i] - thick * (vec / vec.Z);
          v_d_gap[i] = dp;
        }
        //v_u_gap[6] = v_u_gap[0];
        //v_d_gap[6] = v_d_gap[0];
        e.o_gap_u = new Polyline(v_u_gap);
        e.o_gap_d = new Polyline(v_d_gap);
      }
    }

    public Edge findNakedPair(Edge e){
      Node clothed = isNaked(e.nodeN) ? e.nodeP : e.nodeN;
      Node naked = isNaked(e.nodeP) ? e.nodeP : e.nodeN;
      int count = clothed.adjNodes.Count;
      Node otherNode = clothed.adjNodes.Values[(count + whereamI(naked, clothed) + 1) % count];
      Node pairNode = isNaked(otherNode) ? null : otherNode.adjNodes.Values[(count + whereamI(clothed, otherNode) - 1) % count];
      if (pairNode == null) return null;
      return findEdgeNoDir(otherNode, pairNode);
    }

    public Edge findNakedAdjEdgeN(Edge e){
      if(isNaked(e.nodeN)){
        return null;
      }
      else{
        Node clothed = e.nodeP;
        int count = clothed.adjNodes.Count;
        Node otherNode = clothed.adjNodes.Values[(whereamI(e.nodeN, e.nodeP) + 1) % count];
        return findEdgeNoDir(clothed, otherNode);
      }
    }

    public Edge findNakedAdjEdgeP(Edge e){
      if(isNaked(e.nodeP)){
        return null;
      }
      else{
        Node clothed = e.nodeN;
        int count = clothed.adjNodes.Count;
        Node otherNode = clothed.adjNodes.Values[(whereamI(e.nodeP, e.nodeN) + 1) % count];
        return findEdgeNoDir(clothed, otherNode);
      }
    }

    //Create face list in graph and each face's corresponding nexor
    public List<List<Line>> getNexors(){
      List<Edge> candE = getClothedEdges();
      List<List<Line>> nexorList = new List<List<Line>>();
      List<Edge> remainEdge = new List<Edge>(candE);
      foreach(Edge e in candE){
        Edge pair = findPair(e);
        List<Line> thisNexor = new List<Line>();
        List<Node> thisFace = new List<Node>();
        //General case: for all the clothed edges
        if(remainEdge.Contains(e) && pair != null && !isNaked(pair)){
          //common case: all edges are clothed and pair are clothed as well, resulting in clothed faces
          thisNexor.Add(e.mirror);
          thisNexor.Add(e.nodeP.pitLns[(1 + whereamI(e.nodeN, e.nodeP)) % e.nodeP.adjNodes.Count]);

          Edge edge2 = findAdjEdgeP(e);
          thisNexor.Add(edge2.anchor);
          thisNexor.Add(edge2.nodeN.pitLns[(whereamI(edge2.nodeP, edge2.nodeN)) % edge2.nodeN.adjNodes.Count]);

          thisNexor.Add(pair.mirror);
          thisNexor.Add(pair.nodeP.pitLns[(1 + whereamI(pair.nodeN, pair.nodeP)) % pair.nodeP.adjNodes.Count]);

          Edge edge4 = findAdjEdgeN(e);
          thisNexor.Add(edge4.anchor);
          thisNexor.Add(edge4.nodeN.pitLns[(whereamI(edge4.nodeP, edge4.nodeN)) % edge4.nodeN.adjNodes.Count]);

          thisFace.Add(e.nodeP);
          thisFace.Add(edge2.nodeN);
          thisFace.Add(pair.nodeP);
          thisFace.Add(edge4.nodeN);

          remainEdge.Remove(pair);
          nexorList.Add(thisNexor);
          faces.Add(thisFace);
        }
        else if(pair == null){
          //case: edge is clothed, but pair is null, result in a naked face
          thisNexor.Add(e.mirror);
          thisNexor.Add(e.nodeP.pitLns[(1 + whereamI(e.nodeN, e.nodeP)) % e.nodeP.adjNodes.Count]);

          Edge edge2 = findAdjEdgeP(e);
          Edge edge4 = findAdjEdgeN(e);
          if(edge2.nodeN.corners.Count > 2 || edge4.nodeP.corners.Count > 2){
            //case:inside turning corner side,aka concave corner
            thisNexor.Add(edge2.anchor);
            if(edge2.nodeN.corners.Count > 2){
              Point3d cornerC = edge2.anchor.PointAt(1.0);
              thisNexor.Add(new Line(cornerC, (Point3d) edge4.nodeP.hins[0]));
            }
            else if(edge4.nodeP.corners.Count > 2){
              List<Vector3d> cand = edge4.nodeP.hins;
              SortedList<double,Vector3d> dirs = new SortedList<double,Vector3d>();
              foreach(Vector3d c in cand){
                Vector3d direction = c - edge2.nodeN.hins[0];
                direction.Unitize();
                Vector3d based = edge2.nodeN.hins[0] - edge2.nodeN.hins[1];
                based.Unitize();
                double angle = direction * based;
                dirs.Add(angle, c);
              }
              Line edgeL = new Line((Point3d) dirs.Values[2], (Point3d) edge2.nodeN.hins[0]);
              thisNexor.Add(edgeL);
            }
            thisNexor.Add(edge4.anchor);
            thisNexor.Add(edge4.nodeN.pitLns[(whereamI(edge4.nodeP, edge4.nodeN)) % edge4.nodeN.adjNodes.Count]);
          }
          else{
            //case: common naked face with a clothed pair edge
            thisNexor.Add(edge2.anchor);
            thisNexor.Add(new Line((Point3d) edge2.nodeN.hins[0], (Point3d) edge4.nodeP.hins[0]));
            thisNexor.Add(edge4.anchor);
            thisNexor.Add(edge4.nodeN.pitLns[(whereamI(edge4.nodeP, edge4.nodeN)) % edge4.nodeN.adjNodes.Count]);
          }

          thisFace.Add(edge2.nodeP);
          thisFace.Add(edge4.nodeN);
          thisFace.Add(edge4.nodeP);
          thisFace.Add(edge2.nodeN);
          nexorList.Add(thisNexor);
          faces.Add(thisFace);
        }
      }

      //clear things around; discuss naked edge condition
      candE = new List<Edge>(getNakedEdges());
      remainEdge = new List<Edge>(candE);

      foreach(Edge e in candE){
        if(remainEdge.Contains(e)){
          List<Line> thisNexor = new List<Line>();
          List<Node> thisFace = new List<Node>();
          if(findNakedPair(e) != null){
            //there is a naked pair, meaning it's not a outside turning face
            thisNexor.Add(e.mirror);
            Node clothed = isNaked(e.nodeN) ? e.nodeP : e.nodeN;
            Node naked = isNaked(e.nodeP) ? e.nodeP : e.nodeN;
            int count = clothed.adjNodes.Count;
            Node otherNode = clothed.adjNodes.Values[(count + whereamI(naked, clothed) + 1) % count];
            Edge side = findEdgeNoDir(otherNode, clothed);
            thisNexor.Add(clothed.pitLns[(1 + whereamI(naked, clothed)) % clothed.adjNodes.Count]);
            thisNexor.Add(side.anchor);
            thisNexor.Add(otherNode.pitLns[whereamI(clothed, otherNode)]);

            thisNexor.Add(findNakedPair(e).mirror);
            Node nakedS = isNaked(findNakedPair(e).nodeN) ? findNakedPair(e).nodeN : findNakedPair(e).nodeP;
            Line edgeL = new Line();
            if(naked.corners.Count == 3 || nakedS.corners.Count == 3){
              //inside turning corner
              int nCount = naked.corners.Count;
              int sCount = nakedS.corners.Count;
              if(nCount > 3 || sCount > 3){
                nakedS = findNakedPair(e).nodeN == otherNode ? findNakedPair(e).nodeP : findNakedPair(e).nodeN;
                Edge spair = findEdgeNoDir(nakedS, naked);
                thisNexor.Add(nakedS.pitLns[(1 + whereamI(otherNode, nakedS)) % nakedS.adjNodes.Count]);
                thisNexor.Add(spair.anchor);
                int ks = getK(naked);
                thisNexor.Add(new Line((Point3d) naked.hins[ks], (Point3d) naked.pits[ks]));

                thisFace.Add(clothed);
                thisFace.Add(naked);
                thisFace.Add(nakedS);
                thisFace.Add(otherNode);
              }
              else{
                Node naked3 = nCount == 3 ? naked : nakedS;
                Node naked2 = nCount != 3 ? naked : nakedS;
                thisNexor.Add(naked2.pitLns[0]);
                List<Vector3d> cand = naked3.hins;
                SortedList<double,Vector3d> dirs = new SortedList<double,Vector3d>();
                foreach(Vector3d c in cand){
                  Vector3d direction = c - naked2.hins[1];
                  direction.Unitize();
                  Vector3d based = naked2.pits[1] - naked2.pits[0];
                  based.Unitize();
                  double angle = direction * based;
                  dirs.Add(angle, c);
                }
                edgeL = new Line((Point3d) dirs.Values[1], (Point3d) naked2.hins[1]);
                thisNexor.Add(edgeL);
                bool needReverse = naked3.adjNodes.Keys[1] - naked3.adjNodes.Keys[0] > Math.PI;
                int k3 = !needReverse ? (2 + getK(naked3) - 1) % 2 : (2 + getK(naked3) ) % 2;
                thisNexor.Add(naked3.pitLns[k3]);

                thisFace.Add(clothed);
                thisFace.Add(naked);
                thisFace.Add(nakedS);
                thisFace.Add(otherNode);
              }
            }
            else{
              //common side naked face
              //thisNexor.Add(nakedS.pitLns[0]);
              edgeL = new Line((Point3d) nakedS.pits[1], (Point3d) naked.pits[1]);
              thisNexor.Add(edgeL);
              //thisNexor.Add(naked.pitLns[0]);

              thisFace.Add(clothed);
              thisFace.Add(naked);
              thisFace.Add(nakedS);
              thisFace.Add(otherNode);
            }

            remainEdge.Remove(findNakedPair(e));
          }
          else{
            //outside turning face, has three corresponding node only
            thisNexor.Add(e.mirror);
            Node clothed = isNaked(e.nodeN) ? e.nodeP : e.nodeN;
            Node naked = isNaked(e.nodeP) ? e.nodeP : e.nodeN;
            int count = clothed.adjNodes.Count;
            Node otherNode = clothed.adjNodes.Values[(count + whereamI(naked, clothed) + 1) % count];
            Edge side = findEdgeNoDir(otherNode, clothed);
            thisNexor.Add(clothed.pitLns[(1 + whereamI(naked, clothed)) % clothed.adjNodes.Count]);
            thisNexor.Add(side.anchor);
            //thisNexor.Add(otherNode.hinLns[0]);
            Vector3d diagnal = naked.hins[1] - otherNode.hins[0];
            Vector3d dir1 = e.mirror.PointAt(0.0) - e.mirror.PointAt(1.0);
            dir1.Unitize();
            double len = diagnal * dir1;
            Point3d corner = (Point3d) otherNode.hins[0] + len * dir1;
            thisNexor.Add(new Line((Point3d) otherNode.hins[0], corner));
            thisNexor.Add(new Line(corner, (Point3d) naked.pits[1]));
            //thisNexor.Add(naked.pitLns[0]);

            thisFace.Add(clothed);
            thisFace.Add(naked);
            thisFace.Add(otherNode);
          }
          remainEdge.Remove(e);
          nexorList.Add(thisNexor);
          faces.Add(thisFace);
        }
      }
      return nexorList;
    }

    public bool isNaked(Node n){
      return n.corners.Count != n.adjNodes.Count;
    }

    public bool isNaked(Edge e){
      return isNaked(e.nodeN) || isNaked(e.nodeP);
    }

    public List<Node> getNakedNodes(){
      List<Node> nakedN = new List<Node>();
      foreach(Node n in nodes){
        if (isNaked(n)){
          nakedN.Add(n);
        }
      }
      return nakedN;
    }

    public List<Edge> getNakedEdges(){
      List<Edge> nakedE = new List<Edge>();
      foreach(Edge e in edges){
        if(isNaked(e)){
          nakedE.Add(e);
        }
      }
      return nakedE;
    }

    public List<Node> getClothedNodes(){
      List<Node> clothedN = new List<Node>();
      foreach(Node n in nodes){
        if (!isNaked(n)){
          clothedN.Add(n);
        }
      }
      return clothedN;
    }

    public List<Edge> getClothedEdges(){
      List<Edge> clothedE = new List<Edge>();
      foreach(Edge e in edges){
        if(!isNaked(e)){
          clothedE.Add(e);
        }
      }
      return clothedE;
    }

  }

  class Volume : Graph{
    public double vHeight;
    public double vBase = 0.0;

    public Volume(Graph g, double bottom, double height){
      nodes = g.nodes;
      edges = g.edges;
      faces = g.faces;
      vHeight = height;
      vBase = bottom;
    }

    public List<List<Line>> createNexorHeight(){
      base.updateHinPit(vBase);
      List<List<Line>> nexors = new List<List<Line>>();
      List<List<Line>> nexorsBottom = base.getNexors();
      base.updateHinPit(vHeight);
      List<List<Line>> nexorsTop = base.getNexors();
      for(int j = 0;j < nexorsTop.Count;j++){
        //List<Line> sublist = new List<Line>();
        //for(int i = 0;i < nexorsTop[j].Count;i++){
        //  Line bottomLn = nexorsBottom[j][i];
        //  Line topLn = nexorsTop[j][i];
        //  Point3d bottomPt = bottomLn.PointAt(0.0);
        //  Point3d topPt = topLn.PointAt(0.0);
        //  Line thisVertical = new Line(bottomPt, topPt);
        //  sublist.Add(thisVertical);
        //}
        nexors.Add(nexorsTop[j]);
        nexors.Add(nexorsBottom[j]);
        //nexors.Add(sublist);
      }
      return nexors;
    }
  }
# ---------- end graph_of_nodes ----------
item_10 = ListItem(List=pt_3, Index=graph_of_nodes.startIndex, Wrap=True)
crv_8 = Curve(graph_of_nodes.D)
crv_9 = Curve(graph_of_nodes.B)
graph_of_nodes_2 = CSharpScript(
    v=pt_3,
    l=num_6,
    list_RA=num_5,
    RA_Faces=c_script_5.RA_Faces,
    ang_GP=c_script_6.ang_GP,
    isOnGround=smaller.SmallerThan,
    tilt=rad,
    height=num,
    i_base=addition,
    offset=number_slider_4)  # -> out, A, B, C, D, traversal, DoFs, startIndex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; inputs v: list of Point3d, l: tree of Int32, list_RA: list of Int32, RA_Faces: tree of Mesh, ang_GP: list of Double, isOnGround: list of Boolean, tilt: Double, height: Double, i_base: Double, offset: Double; same code as graph_of_nodes
crv_10 = Curve(graph_of_nodes.A)
crv_11 = Curve(graph_of_nodes.C)

# ---- group: CNC Cutting generation
number_slider_5 = Slider(0.0699, range=0..0.8)
number_slider_6 = Slider(1.5875, range=0..10)
explode_2 = Explode(Curve=crv_10, Recursive=True)  # -> Segments, simplify(Vertices)
explode_3 = Explode(Curve=crv_11, Recursive=True)  # -> Segments, simplify(Vertices)
addition_2 = Addition(A=number_slider_6, B=Slider(1.7, range=0..10))
explode_4 = Explode(Curve=crv_8, Recursive=True)  # -> Segments, simplify(Vertices)
explode_5 = Explode(Curve=crv_9, Recursive=True)  # -> Segments, simplify(Vertices)
c_script_7 = CSharpScript(gap_o=explode_2.Vertices, gap_d=explode_3.Vertices, drillD=addition_2, hingeW=number_slider_5)  # -> out, A, B; inputs gap_o: tree of Point3d, gap_d: tree of Point3d, drillD: Double, hingeW: Double
# ---------- c_script_7: C# ----------
    List<List<Point3d>> ptsList = new List<List<Point3d>>();
    DataTree<Point3d> ptsTree = new DataTree<Point3d>();
    for(int i = 0;i < gap_o.BranchCount;i++){
      List<Point3d> ipts = new List<Point3d>();
      Point3d hinP = gap_o.Branches[i][0];
      Point3d anchorP = gap_o.Branches[i][1];
      Point3d pitP = gap_o.Branches[i][2];
      Point3d pitN = gap_o.Branches[i][3];
      Point3d anchorN = gap_o.Branches[i][4];
      Point3d hinN = gap_o.Branches[i][5];
      Point3d dhinP = gap_d.Branches[i][0];
      Point3d danchorP = gap_d.Branches[i][1];
      Point3d dpitP = gap_d.Branches[i][2];
      Point3d dpitN = gap_d.Branches[i][3];
      Point3d danchorN = gap_d.Branches[i][4];
      Point3d dhinN = gap_d.Branches[i][5];

      Vector3d dir = anchorP - anchorN;
      dir.Unitize();
      Point3d hingeP = anchorP - hingeW * dir;
      Point3d hingeN = anchorN + hingeW * dir;
      Line dpitPl = new Line(danchorP, dpitP);
      Line dpitNl = new Line(danchorN, dpitN);
      dir.Transform(Transform.Rotation(Math.PI / 4, hingeP));
      Line rayP = new Line(hingeP, dir);
      double trayP;
      double tpitP;
      Rhino.Geometry.Intersect.Intersection.LineLine(rayP, dpitPl, out trayP, out tpitP);
      Point3d hinP1 = tpitP > -1 ? rayP.PointAt(trayP) : danchorP;

      dir.Transform(Transform.Rotation(Math.PI / 2, hingeN));
      Line rayN = new Line(hingeN, dir);
      double trayN;
      double tpitN;
      Rhino.Geometry.Intersect.Intersection.LineLine(rayN, dpitNl, out trayN, out tpitN);
      Point3d hinN1 = tpitN > -1 ? rayN.PointAt(trayN) : danchorN;

      Vector3d offsetP = dir * drillD;
      Point3d hinP_1 = hingeP + offsetP;
      dir.Transform(Transform.Rotation(Math.PI / 2, hinP_1));
      Line rayP_ = new Line(hinP_1, dir);
      Line dhinPl = new Line(danchorP, dhinP);
      Rhino.Geometry.Intersect.Intersection.LineLine(rayP_, dhinPl, out trayP, out tpitP);
      Point3d hinP_2 = rayP_.PointAt(trayP);

      Vector3d offsetN = -dir * drillD;
      Point3d hinN_1 = hingeN + offsetN;
      dir.Transform(Transform.Rotation(Math.PI / 2, hinN_1));
      Line rayN_ = new Line(hinN_1, dir);
      Line dhinNl = new Line(danchorN, dhinN);
      Rhino.Geometry.Intersect.Intersection.LineLine(rayN_, dhinNl, out trayN, out tpitN);
      Point3d hinN_2 = rayN_.PointAt(trayN);

      Vector3d dirP = dhinP - hinP;
      dirP.Transform(Transform.Rotation(Math.PI * 0.3, hinP));
      rayP = new Line(hinP, dirP);
      Rhino.Geometry.Intersect.Intersection.LineLine(rayP, dhinPl, out trayP, out tpitP);
      Point3d hinP_3 = rayP.PointAt(trayP);
      dirP.Transform(Transform.Rotation(-Math.PI * 0.5, hinP));
      rayP = new Line(hinP, dirP);
      Line anchorL = new Line(dhinP, dhinN);
      Rhino.Geometry.Intersect.Intersection.LineLine(rayP, anchorL, out trayP, out tpitP);
      Point3d hinP_4 = rayP.PointAt(trayP);

      Vector3d dirN = dhinN - hinN;
      dirN.Transform(Transform.Rotation(-Math.PI * 0.3, hinN));
      rayN = new Line(hinN, dirN);
      Rhino.Geometry.Intersect.Intersection.LineLine(rayN, dhinNl, out trayN, out tpitN);
      Point3d hinN_3 = rayN.PointAt(trayN);
      dirN.Transform(Transform.Rotation(Math.PI * 0.5, hinN));
      rayN = new Line(hinN, dirN);
      Rhino.Geometry.Intersect.Intersection.LineLine(rayN, anchorL, out trayN, out tpitN);
      Point3d hinN_4 = rayN.PointAt(trayN);

      ipts.Add(dpitP);
      //ipts.Add(danchorP);
      ipts.Add(hinP1);
      ipts.Add(hingeP);
      ipts.Add(hinP_1);
      //ipts.Add(hinP_2);
      ipts.Add(hinP_3);
      ipts.Add(hinP);
      ipts.Add(hinP_4);
      ipts.Add(hinN_4);
      ipts.Add(hinN);
      ipts.Add(hinN_3);
      //ipts.Add(hinN_2);
      ipts.Add(hinN_1);
      ipts.Add(hingeN);
      //ipts.Add(danchorN);
      ipts.Add(hinN1);
      ipts.Add(dpitN);
      ptsList.Add(ipts);
    }

    //Tree construction for facesList
    for(int i = 0; i < ptsList.Count;i++){
      for(int j = 0;j < ptsList[i].Count;j++){
        ptsTree.Add(ptsList[i][j], new GH_Path(i));
      }
    }
    A = ptsTree;
# ---------- end c_script_7 ----------
c_script_8 = CSharpScript(gap_o=explode_5.Vertices, gap_d=explode_4.Vertices, drillD=addition_2, hingeW=number_slider_5)  # -> out, A, B; inputs gap_o: tree of Point3d, gap_d: tree of Point3d, drillD: Double, hingeW: Double; same code as c_script_7
pline = PolyLine(Vertices=c_script_7.A, Closed=True)
pline_2 = PolyLine(Vertices=c_script_8.A, Closed=True)
fillet = Fillet(Curve=pline, Radius=number_slider_6)
fillet_2 = Fillet(Curve=pline_2, Radius=number_slider_6)
entwine_2 = Entwine(Branch00=pline, Branch01=pline_2, FlattenInputs=True)
entwine_3 = Entwine(Branch00=fillet, Branch01=fillet_2, FlattenInputs=True)
flip_3 = FlipMatrix(Data=entwine_2)
flip_4 = FlipMatrix(Data=entwine_3)
loft = Loft(Curves=flip_3, Options={Adjust=False, Closed=False, LoftEnds=0, LoftSimp=0, LoftType=0, Rebuild=10, Refit=0.01})
loft_2 = Loft(Curves=flip_4, Options={Adjust=False, Closed=False, LoftEnds=0, LoftSimp=0, LoftType=0, Rebuild=10, Refit=0.01})
cap = CapHoles(Brep=loft)
cap_2 = CapHoles(Brep=loft_2)

# ----
crv_12 = Curve(graph_of_nodes.nexor)
join = JoinCurves(Curves=graph_of_nodes.hn, Preserve=False)
crv_13 = Curve(join)
boundary_2 = BoundarySurfaces(Edges=crv_12)
boundary_3 = BoundarySurfaces(Edges=crv_13)
join_2 = JoinCurves(Curves=crv_12, Preserve=False)
debrep = DeconstructBrep(Brep=boundary_3)  # -> Faces, Edges, simplify(Vertices)
disc_4 = Discontinuity(Curve=join_2, Level=1)  # -> Points, Parameters
item_11 = ListItem(List=debrep.Vertices, Index=0, Wrap=True)  # -> Item, Item1, Item2
pt_5 = Point(flatten(disc_4.Points))
pt_6 = Point(item_11.Item)
pt_7 = Point(item_11.Item1)
pt_8 = Point(item_11.Item2)
cp_4 = ClosestPoint(Point=pt_7, Cloud=pt_5)  # -> ClosestPoint, CPIndex, Distance
cp_5 = ClosestPoint(Point=pt_6, Cloud=pt_5)  # -> ClosestPoint, CPIndex, Distance
cp_6 = ClosestPoint(Point=pt_8, Cloud=pt_5)  # -> ClosestPoint, CPIndex, Distance
num_7 = Number(cp_4.CPIndex)
num_8 = Number(cp_5.CPIndex)
num_9 = Number(cp_6.CPIndex)

pt_9 = Point(graph_of_nodes.F)

pline_3 = PolyLine(Vertices=pt_9, Closed=True)
boundary_4 = BoundarySurfaces(Edges=pline_3)

join_3 = JoinCurves(Curves=graph_of_nodes_2.hn, Preserve=False)
crv_14 = Curve(graph_of_nodes_2.nexor)
crv_15 = Curve(join_3)
boundary_5 = BoundarySurfaces(Edges=crv_14)
boundary_6 = BoundarySurfaces(Edges=crv_15)
join_4 = JoinCurves(Curves=crv_14, Preserve=False)
debrep_2 = DeconstructBrep(Brep=boundary_6)  # -> Faces, Edges, simplify(Vertices)

xy_2 = XYPlane(Origin=item_6)
mirror_2 = Mirror(Geometry=boundary_4, Plane=xy_2)  # -> Geometry, Transform
pln = Plane(simplify(boundary_4))
pln_2 = Plane(simplify(mirror_2.Geometry))

orient_2 = Orient(Geometry=simplify(join_2), Source=pln, Target=pln_2)  # -> Geometry, Transform
disc_5 = Discontinuity(Curve=orient_2.Geometry, Level=1)  # -> Points, Parameters

pt_10 = Point(flatten(disc_5.Points))
item_12 = ListItem(List=pt_10, Index=num_8, Wrap=True)
item_13 = ListItem(List=pt_10, Index=num_7, Wrap=True)
item_14 = ListItem(List=pt_10, Index=num_9, Wrap=True)
pl_3pt_2 = Plane3Pt(PointA=cp_5.ClosestPoint, PointB=cp_4.ClosestPoint, PointC=cp_6.ClosestPoint)
pl_3pt_3 = Plane3Pt(PointA=item_12, PointB=item_13, PointC=item_14)

join_5 = JoinCurves(Curves=debrep_2.Edges, Preserve=False)
join_6 = JoinCurves(Curves=debrep.Edges, Preserve=False)
merge_4 = Merge(Data1=simplify(graft(join_6)), Data2=simplify(graft(join_5)))
loft_3 = Loft(Curves=merge_4, Options={Adjust=False, Closed=False, LoftEnds=0, LoftSimp=0, LoftType=0, Rebuild=10, Refit=0.01})
merge_5 = Merge(Data1=simplify(loft_3), Data2=simplify(graft(boundary_3)), Data3=simplify(graft(boundary_6)))
join_7 = BrepJoin(Breps=merge_5)  # -> Breps, Closed

merge_6 = Merge(Data1=join_2, Data2=join_4)
loft_4 = Loft(Curves=merge_6, Options={Adjust=False, Closed=False, LoftEnds=0, LoftSimp=0, LoftType=0, Rebuild=10, Refit=0.01})
merge_7 = Merge(Data1=simplify(loft_4), Data2=simplify(boundary_2), Data3=simplify(boundary_5))
join_8 = BrepJoin(Breps=merge_7)  # -> Breps, Closed

merge_8 = Merge(Data1=join_7.Breps, Data2=join_8.Breps)
orient_3 = Orient(Geometry=simplify(graft(join_7.Breps)), Source=pl_3pt_2, Target=pl_3pt_3)  # -> Geometry, Transform
orient_4 = Orient(Geometry=simplify(join_8.Breps), Source=pln, Target=pln_2)  # -> Geometry, Transform
orient_5 = Orient(Geometry=simplify(boundary_5), Source=pln, Target=pln_2)  # -> Geometry, Transform
preview = CustomPreview(Geometry=merge_8, Material=ColourSwatch(SwatchColor=RGB(158, 99, 60)))
preview_2 = CustomPreview(Geometry=orient_4.Geometry, Material=swatch)
preview_3 = CustomPreview(Geometry=orient_3.Geometry, Material=swatch)

# ---- group: fabrication aware: offset for hinge thickness
disc_6 = Discontinuity(Curve=crv_8, Level=1)  # -> Points, Parameters
disc_7 = Discontinuity(Curve=crv_9, Level=1)  # -> Points, Parameters
disc_8 = Discontinuity(Curve=crv_10, Level=1)  # -> Points, Parameters
disc_9 = Discontinuity(Curve=crv_11, Level=1)  # -> Points, Parameters
pline_4 = PolyLine(Vertices=disc_8.Points, Closed=True)
pline_5 = PolyLine(Vertices=disc_7.Points, Closed=True)
pline_6 = PolyLine(Vertices=disc_6.Points, Closed=True)
pline_7 = PolyLine(Vertices=disc_9.Points, Closed=True)
entwine_4 = Entwine(Branch00=pline_7, Branch01=pline_6, FlattenInputs=True)
flip_5 = FlipMatrix(Data=entwine_4)
loft_5 = Loft(Curves=flip_5, Options={Adjust=False, Closed=False, LoftEnds=0, LoftSimp=0, LoftType=0, Rebuild=10, Refit=0.01})
cap_3 = CapHoles(Brep=loft_5)

# ----
fillet_3 = Fillet(Curve=pline_4, Radius=number_slider_6)
fillet_4 = Fillet(Curve=pline_5, Radius=number_slider_6)

# ---- group: fabrication aware: offset for hinge thickness (continued)
entwine_5 = Entwine(Branch00=fillet_3, Branch01=fillet_4, FlattenInputs=True)
flip_6 = FlipMatrix(Data=entwine_5)
loft_6 = Loft(Curves=flip_6, Options={Adjust=False, Closed=False, LoftEnds=0, LoftSimp=0, LoftType=0, Rebuild=10, Refit=0.01})
cap_4 = CapHoles(Brep=loft_6)

# ----
entwine_6 = Entwine(Branch00=pline_4, Branch01=pline_5, FlattenInputs=True)
flip_7 = FlipMatrix(Data=entwine_6)
loft_7 = Loft(Curves=flip_7, Options={Adjust=False, Closed=False, LoftEnds=0, LoftSimp=0, LoftType=0, Rebuild=10, Refit=0.01})
cap_5 = CapHoles(Brep=loft_7)

# ==== cluster Cluster
F = ClusterInput()
deface = DeconstructFace(Face=F)  # -> graft(CornerA), graft(CornerB), graft(CornerC), graft(CornerD)
merge = Merge(Data1=deface.CornerA, Data2=deface.CornerB, Data3=deface.CornerC, Data4=deface.CornerD)  # -> simplify(Result)
R = ClusterOutput(merge)

# ==== cluster Cluster_2
P = ClusterInput()
polar = ToPolar(Point=P, System=PlaneXY(0, 0, 0), AnglePoleDown=True)  # -> Phi, Theta, Radius
deg = Degrees(Radians=polar.Theta)
division = Division(A=deg, B=Slider(2, range=0..10))
pi = Pi(Factor=Slider(0.5, range=0..1))
rad = Radians(Degrees=division)
subtraction = Subtraction(A=pi, B=rad)
half_normal_list = PointPolar(BasePlane=PlaneXY(0, 0, 0), XYAngle=polar.Phi, ZAngle=subtraction, Offset=polar.Radius)
half_normal_list_2 = ClusterOutput(half_normal_list)

# ==== cluster Cluster_3
P = ClusterInput()
polar = ToPolar(Point=P, System=PlaneXY(0, 0, 0), AnglePoleDown=True)  # -> Phi, Theta, Radius
deg = Degrees(Radians=polar.Theta)
lng = ListLength(List=deg)
series = Series(Start=0, Step=1, Count=lng)
sort = SortList(Keys=deg, ValuesA=series)  # -> Keys, ValuesA
int = Integer(reverse(sort.ValuesA))
item = ListItem(List=int, Index=0, Wrap=True)
int_2 = Integer(item)
int_3 = ClusterOutput(int_2)

# ==== cluster Cluster_4
crv = ClusterInput()
crv_2 = Curve(flatten(crv))
disc = Discontinuity(Curve=crv_2, Level=1)  # -> flatten(Points), Parameters
pdecon = Deconstruct(Point=disc.Points)  # -> XComponent, YComponent, ZComponent
sort = SortList(Keys=pdecon.ZComponent)  # -> Keys, ValuesA
item = ListItem(List=sort.Keys, Index=0, Wrap=True)
Z = UnitZ(Factor=item)
neg = Negative(Value=Z)
move = Move(Geometry=crv, Motion=neg)  # -> Geometry, Transform
G = ClusterOutput(move.Geometry)

# ==== cluster Cluster_5
C = ClusterInput()
join = JoinCurves(Curves=C, Preserve=False)
disc = Discontinuity(Curve=join, Level=1)  # -> Points, Parameters
avr = Average(Input=disc.Points)  # -> simplify(ArithmeticMean)
am = ClusterOutput(avr)
